# Grasshopper definition pouch_develop_1214_quad.gh (Grasshopper 1.0.7)
# plug-ins: Kangaroo2 Components, MeshEdit Components

# ----
# 鞍形
# approximated sphere
# icsohedron
# thermorph bunny
# tetrahedron
# mv共存パターン
# rectangle
number_slider = Slider(1.5, range=0.5..4)
mesh = Mesh(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)
mesh_2 = Mesh(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)
mesh_3 = Mesh(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)
number_slider_2 = Slider(100, range=0..100)
brep = Brep(<brep referenced from the Rhino model>)
mesh_4 = Mesh(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)
# input 3D data
srf = Surface(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)
simple_mesh = SimpleMesh(Brep=brep)
scale_nu = ScaleNU(Geometry=srf, Plane=PlaneXY(0, 0, 0), ScaleX=1, ScaleY=1, ScaleZ=number_slider)  # -> Geometry, Transform
rectangle = Rectangle(Plane=PlaneXY(0, 0, 0), XSize=number_slider_2, YSize=number_slider_2, Radius=0)  # -> Rectangle, Length
msphere = MeshSphere(Base=PlaneXY(0, 0, 0), Radius=Slider(35, range=0..100), UCount=10, VCount=20)
weldvertices = MeshWeldVertices(Mesh=simple_mesh, Tolerance=0.01)  # -> RuntimeMessage, Mesh
boxrec = BoxRectangle(Rectangle=rectangle.Rectangle, Height=number_slider_2)
scale = Scale(Geometry=mesh_4, Center=Point(0, 0, 0), Factor=Slider(0.5, range=0..1))  # -> Geometry, Transform
scale_2 = Scale(Geometry=scale_nu.Geometry, Center=Point(0, 0, 0), Factor=Slider(2.5, range=0.5..4))  # -> Geometry, Transform
triremesh = TriRemesh(Geometry=msphere, Length=Slider(28, range=0..100), Iterations=25)  # -> Triangulation, Dual, Creases
weldvertices_2 = MeshWeldVertices(Mesh=boxrec, Tolerance=0.01)  # -> RuntimeMessage, Mesh
triremesh_2 = TriRemesh(Geometry=scale_2.Geometry, Length=Slider(40, range=10..40), Iterations=25)  # -> Triangulation, Dual, Creases
mesh_5 = Mesh(scale.Geometry)
mesh_6 = Mesh(weldvertices_2.Mesh)

brep_2 = Brep(<brep referenced from the Rhino model>)
simple_mesh_2 = SimpleMesh(Brep=brep_2)
mesh_7 = Mesh(<mesh referenced from the Rhino model>)
brep_3 = Brep(<brep referenced from the Rhino model>)
weldvertices_3 = MeshWeldVertices(Mesh=simple_mesh_2, Tolerance=0.01)  # -> RuntimeMessage, Mesh
simple_mesh_3 = SimpleMesh(Brep=brep_3)
brep_4 = Brep(<brep referenced from the Rhino model>)
brep_5 = Brep(<brep referenced from the Rhino model>)
scale_3 = Scale(Geometry=mesh_7, Center=Point(0, 0, 0), Factor=Slider(12, range=0..100))  # -> Geometry, Transform
brep_6 = Brep(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)
mesh_8 = Mesh(weldvertices_3.Mesh)
weldvertices_4 = MeshWeldVertices(Mesh=simple_mesh_3, Tolerance=0.01)  # -> RuntimeMessage, Mesh
simple_mesh_4 = SimpleMesh(Brep=brep_4)
simple_mesh_5 = SimpleMesh(Brep=brep_5)
simple_mesh_6 = SimpleMesh(Brep=brep_6)
weldvertices_5 = MeshWeldVertices(Mesh=scale_3.Geometry, Tolerance=0.01)  # -> RuntimeMessage, Mesh
weldvertices_6 = MeshWeldVertices(Mesh=simple_mesh_4, Tolerance=0.01)  # -> RuntimeMessage, Mesh
weldvertices_7 = MeshWeldVertices(Mesh=simple_mesh_5, Tolerance=0.01)  # -> RuntimeMessage, Mesh
weldvertices_8 = MeshWeldVertices(Mesh=simple_mesh_6, Tolerance=0.01)  # -> RuntimeMessage, Mesh
mesh_9 = Mesh(weldvertices_4.Mesh)
mesh_10 = Mesh(weldvertices_5.Mesh)
mesh_11 = Mesh(mesh_8)
mesh_12 = Mesh(weldvertices_6.Mesh)
panel = Panel(mesh_10)
mesh_13 = Mesh(mesh_12)
dam = DataDam(DataA=mesh_13, BufferDelay=10000000, BufferMode=0)
# algorithm
number_slider_3 = Slider(19, range=0..100)
# select 2D mesh
enum_net = GhPythonScript(mesh=dam, max_len_tree=Slider(10, range=0..100))  # -> out, result, refF, tmp; inputs mesh: Mesh, max_len_tree: Int32
# ---------- enum_net: Python ----------
from ghpythonlib.componentbase import executingcomponent as component
import ghpythonlib.components as gc
import Grasshopper, GhPython
import System
import Rhino.Geometry as rg
import rhinoscriptsyntax as rs
import math
import sys
import copy
            
from Grasshopper.Kernel.Data import GH_Path
from Grasshopper import DataTree

import ghpythonlib.treehelpers as gt

x_3d = rg.Vector3d(1,0,0)
x_2d = rg.Vector2d(1,0)
x_3f = rg.Vector3f(1,0,0)
x_2f = rg.Vector2f(1,0)
y_3d = rg.Vector3d(0,1,0)
y_2d = rg.Vector2d(0,1)
y_3f = rg.Vector3f(0,1,0)
y_2f = rg.Vector2f(0,1)

round_num = 2

# -------------------------------- Crane Function------------------------------------------------
def GetVertexPairTwoConnectedFaces(mesh, f1, f2):
    """
    Parameters
    mesh Type:Rhino.Geometry.Mesh
    f1   Type:System.Int32
         The first face index.
    f2   Type:System.Int32
         The second face index.
    """
    E1 = []
    E2 = []
    F1 = mesh.TopologyEdges.GetEdgesForFace(f1)
    F2 = mesh.TopologyEdges.GetEdgesForFace(f2)
    VF1 = []
    VF2 = []
    for i in F1:
        VF1.append(mesh.TopologyEdges.GetTopologyVertices(i))
    for i in F2:
        VF2.append(mesh.TopologyEdges.GetTopologyVertices(i))
    for i in VF1:
         for j in VF2:
             if i[0] in j:
                 if i[1] in j:
                     return i


def TreeSort(tree, root, count):
    max = 1
    i = 0
    pts = []
    sorted = []
    for j in range(len(tree)):
        e = tree[j-i]
        if root in e:
            i += 1
            if e[0] != root:
                pts.append(e[0])
                sorted.append([root, e[0]])
                tree.remove(e)
            else:
                pts.append(e[1])
                sorted.append([root, e[1]])
                tree.remove(e)
    while (len(pts) != 0):
        pts2 = []
        for v in pts:
            i = 0
            for j in range(len(tree)):
                e = tree[j-i]
                if v in e:
                    i += 1
                    if e[0] != v:
                        pts2.append(e[0])
                        sorted.append([v,e[0]])
                        tree.remove(e)
                    else:
                        pts2.append(e[1])
                        sorted.append([v,e[1]])
                        tree.remove(e)
        pts = pts2
    return sorted
# -------------------------------- Liner Algebla ------------------------------------------------
def transposeMatrix(m):
    return map(list,zip(*m))

def getMatrixMinor(m,i,j):
    return [row[:j] + row[j+1:] for row in (m[:i]+m[i+1:])]

def getMatrixDeternminant(m):
    #base case for 2x2 matrix
    if len(m) == 2:
        return m[0][0]*m[1][1]-m[0][1]*m[1][0]

    determinant = 0
    for c in range(len(m)):
        determinant += ((-1)**c)*m[0][c]*getMatrixDeternminant(getMatrixMinor(m,0,c))
    return determinant

def getMatrixInverse(m):
    determinant = getMatrixDeternminant(m)
    #special case for 2x2 matrix:
    if len(m) == 2:
        return [[m[1][1]/determinant, -1*m[0][1]/determinant],
                [-1*m[1][0]/determinant, m[0][0]/determinant]]

    #find matrix of cofactors
    cofactors = []
    for r in range(len(m)):
        cofactorRow = []
        for c in range(len(m)):
            minor = getMatrixMinor(m,r,c)
            cofactorRow.append(((-1)**(r+c)) * getMatrixDeternminant(minor))
        cofactors.append(cofactorRow)
    cofactors = transposeMatrix(cofactors)
    for r in range(len(cofactors)):
        for c in range(len(cofactors)):
            cofactors[r][c] = cofactors[r][c]/determinant
    return cofactors

def CrossProduct2D(v1,v2):
    if type(v1) != 'Vector2d':
        v1 = rg.Vector2d(v1[0],v1[1])
    if type(v2) != 'Vector2d':
        v2 = rg.Vector2d(v2[0],v2[1])
    return (v1.X*v2.Y)-(v1.Y*v2.X)
    
def CrossProduct3D(v1,v2):
    return v1.CrossProduct(v1,v2)
    
# -------------------------------- Primitive Geometry -------------------------------------------
def middlepoint(line):
    p1 = line.From
    p2 = line.To
    return (p1+p2)/2
    




# -------------------------------- Computation on FAG -------------------------------------------
class graph(object):
    def __init__(self, vertices, edges):
        self.edges = edges
        self.vertices = vertices
    def set_edges(self, edges):
        self.edges = edges
    def set_vertices(self, vertices):
        self.vertices = vertices
    def print_edges(self):
        print(self.edges)
    def print_vertices(self):
        print(self.vertices)

def firsttree(G):
    vflag = [0]*len(G.vertices)
    sptree = []
    for e in G.edges:
        if sum(vflag) == len(G.vertices):
            break
        if vflag[e[0]] == 0 or vflag[e[1]] == 0:
            sptree.append(e)
            vflag[e[0]] = 1
            vflag[e[1]] = 1
    return sptree

def dfstree(origV,origE,V,E,Vflag,vnow):
    ecan = []
    for e in origE:
        if vnow in e:
            ecan.append(e)
    for e in ecan:
        if e[0] == vnow:
            partialv = e[1]
        else:
            partialv = e[0]
        if Vflag[partialv] != 1:
            Vflag[partialv]= 1
            V.append(partialv)
            E.append(e)
            dfstree(origV,origE,V,E,Vflag, partialv)
    return 

def myindex(l,item):
    if item in l:
        return l.index(item)
    else:
        return -1

def Sigma(newV):
    sigma = [0] *len(newV)
    for i,v in enumerate(newV):
        sigma[v] = i
    return sigma


def  mergesort_edge(lst):
    if  len(lst) <= 1:
        return lst
    mid = len(lst) // 2
    # ここで分割を行う
    left = lst[:mid]
    right = lst[mid:]
    left = mergesort_edge(left)
    right = mergesort_edge(right)
    return merge_edge(left,right)

def merge_edge(left,right):
    merged = []
    l_i, r_i = 0,0
    while l_i < len(left) and r_i < len(right):
        # ここで=をつけることで安定性を保っている
        if min(left[l_i]) < min(right[r_i]):
            merged.append(left[l_i])
            l_i += 1
        elif min(left[l_i]) > min(right[r_i]):
            merged.append(right[r_i])
            r_i += 1
        else:
            #これはminが同じだった場合で，エッジのもう一端で判別
            if max(left[l_i]) < max(right[r_i]):
                merged.append(left[l_i])
                l_i += 1
            elif max(left[l_i]) > max(right[r_i]):
                merged.append(right[r_i])
                r_i += 1
    if l_i < len(left):
        merged.extend(left[l_i:])
    if r_i < len(right):
        merged.extend(right[r_i:])
    return merged


def sortT0(tree):
    V = [i for i in range(len(tree.vertices))]
    E = []
    sigma = Sigma(tree.vertices)
    for i,e in enumerate(tree.edges):
        E.append([sigma[e[0]],sigma[e[1]]])
    t0 = graph(V,E)
    return t0,sigma

def sortVandE(origE,t0,sigma):
    allE = []
    for i,e in enumerate(origE):
        allE.append([sigma[e[0]],sigma[e[1]]])
    EnotT0 = []
    for i,e in enumerate(allE):
        if e not in t0.edges:
            EnotT0.append(e)
    EsortnotT0 = mergesort_edge(EnotT0)
    Esorted = t0.edges+EsortnotT0
    sorted_gragh = graph(t0.vertices, Esorted)
    return sorted_gragh

def GraphConnection(G,targetgraph):
    Connection = [[] for i in range(len(G.vertices))]
    for i,e in enumerate(targetgraph.edges):
        Connection[e[0]].append(e)
        Connection[e[1]].append(e)
    return Connection

def recrusive_Vsearch(vnow,vprev,EdgeConnection,Vs):
    es = EdgeConnection[vnow]
    if len(es) == 1:
        Vs.append(vnow)
        return 
    Vs.append(vnow)
    for e in es:
        if myindex(e, vprev) == -1:
            if e[0] == vnow:
                vnext = e[1]
            else:
                vnext = e[0]
            recrusive_Vsearch(vnext,vnow,EdgeConnection,Vs)
    return Vs

def search_two_components(T,ek,G):
    v1 = min(ek)
    v2 = max(ek)
    treeconnection = GraphConnection(G,T)
    V1 = []
    recrusive_Vsearch(v1, v2, treeconnection, V1)
    V2 = list(set(V1)^set(T.vertices))
    return V1,V2

def Cut(T, ek, G):
    cut = []
    origGConnection = GraphConnection(G,G)
    V1, V2 = search_two_components(T,ek,G)
    for i,v in enumerate(V1):
        for j,e in enumerate(origGConnection[v]):
            if e not in T.edges:
                if e[0] == v:
                    vcon = e[1]
                else:
                    vcon = e[0]
                if vcon in V2:
                    cut.append(myindex(G.edges,e))
    cut.append(myindex(G.edges,ek))
    return cut

def Entr(Tp,T0,ek,G):
    CutT0 = Cut(T0, ek, G)
    CutTp = Cut(Tp, ek, G)
    entrys = list((set(CutT0)&set(CutTp)))
    entrys.remove(myindex(G.edges,ek))
    return entrys

def find_children(Tp,T0,k, G, sptree, nmax):#Entrを使う方で実装．全てのV,EのインデックスはソートされたGに基づいたインデックスになるように注意
    if k < 0:
        return 
    if len(sptree) >= nmax:
        return 
    ek = G.edges[k]
    g_list = Entr(Tp, T0, ek, G)
    for i,g in enumerate(g_list):
        ek_id_inTp = myindex(Tp.edges, ek)
        g_id_inTp = myindex(Tp.edges, g)
        Ec = copy.deepcopy(Tp.edges)
        Ec.pop(ek_id_inTp)
        Ec.append(G.edges[g])
        Tc = graph(G.vertices,Ec)
        sptree.append(Tc)
        find_children(Tc,T0, k-1, G, sptree, nmax)
    find_children(Tp, T0, k-1, G, sptree, nmax)

def EnumSPTrees(origG, nmax): #G=[V,E]
    origV = origG.vertices
    #print(origV)
    origE = origG.edges
    #print(origE)
    V = []
    E = []
    Vflag = [-1] * len(origV)
    Vflag[0] = 1
    V.append(origV[0])
    dfstree(origV,origE,V,E,Vflag, origV[0])
    t0 = graph(V,E)
    # print(t0)
    s = sortT0(t0)
    T0 = s[0]
    # print(T0)
    sigma = s[1]
    G= sortVandE(origE,T0,sigma)
    #return G
    
    EdgeConnection = GraphConnection(G,G)

    SpTree = [T0]
    find_children(T0, T0, (len(G.vertices)-1)-1,G, SpTree, nmax)
    return SpTree, G, sigma




class HalfEdge(object):
        def __init__(self,v):
            self.next = None
            self.prev = None
            self.vertex = v
            if v.he == None:
                v.he = self
            self.face = None
            self.pair = None
            
        def set_next(self,he_next):
            self.next = he_next
        def set_prev(self,he_prev):
            self.prev = he_prev
        def set_pair(self,he_pair):
            self.prev = he_pair
        def set_face(self,face):
            self.face = face
            if face.he == None:
                face.he = self

class HEFace(object):
    def __init__(self):
        self.he = None
class HEVertex(object):
    def __init__(self,v):
        self.v = v
        self.he = None
def setHalfEdgePair(HEs):
    for he_search in HEs:
        #print('search={} to {}'.format(he_search.vertex.v, he_search.next.vertex.v))
        for he_cand in HEs:
            #print('cand={} to {}'.format(he_cand.vertex.v, he_cand.next.vertex.v))
            if he_search.next.vertex == he_cand.vertex and he_search.vertex == he_cand.next.vertex:
                if he_search.pair == None:
                    he_search.pair = he_cand
                if he_cand.pair == None:
                    he_cand.pair = he_search      
                    
                    
def ConstructHalfEdge(MeshV,MeshF):
    #print(type(MeshF))
#     def __init__(self,MeshV,MeshF):
    Faces = []
    Vertices = []
    for mvid, mv in enumerate(MeshV):
        Vertices.append(HEVertex(mv))#consrtuct v, halfedge is null
    #print(Vertices)
    Halfedges = []
    for mfid, mf in enumerate(MeshF):
        face = HEFace() #construct f, halfedge is null
        Faces.append(face)
        if mf.IsTriangle:
            mvids = [mf.A, mf.B, mf.C]
        else:
            mvids = [mf.A, mf.B, mf.C, mf.D]   #すべてのfaceがrectangleであるという前提に基づいている
        hes = []
        for i in range(len(mvids)):
            v = Vertices[mvids[i]]#mesh vertex and vertex of halfedge have same corrdinates for same id
            he = HalfEdge(v)
            hes.append(he)
        for i,he in enumerate(hes):
            if i == len(hes)-1:
                he.set_next(hes[0])
                he.set_prev(hes[i-1])
            else:
                he.set_next(hes[i+1])
                he.set_prev(hes[i-1])
            he.set_face(face)
            Halfedges.append(he)

    setHalfEdgePair(Halfedges)
    
    return Vertices, Faces, Halfedges
    
    
def GetFAG(mesh):
    v = mesh.Vertices
    f = mesh.Faces
    HEV,HEF, HE = ConstructHalfEdge(v,f)
    FAG_node = [fid for fid in range(len(HEF))]
    #print('FAG_node={}'.format(FAG_node))
    FAG_edge = []
    for he in HE:
        try:
            facepair = [HEF.index(he.face), HEF.index(he.pair.face)]
            if facepair[0] != facepair[1]:
                if facepair not in FAG_edge and facepair[::-1] not in FAG_edge:
                    FAG_edge.append(facepair)
        except:
            pass
    FAG = graph(FAG_node,FAG_edge)
    return FAG
    
    
    
# -----------------------------------------------------------------------------------------------
def FaceDev0(M, i, refV, devF):
    """"
    まずi番目(実際はroot)のfaceをxy平面に展開する
    これはsptreeをrootからの順番でソートしているから可能
    """
    V = M.Vertices
    F = M.Faces
    flen = 3 if F[i].IsTriangle else 4
    a = []
    for j in range(flen):
        a.append(V[F[i][j]])
    xaxis = rg.Vector3d.Subtract(rs.coerce3dvector(a[1]),rs.coerce3dvector(a[0]))
    zaxis = gc.FaceNormals(M)[1][i]
    yaxis = rs.VectorCrossProduct(zaxis,xaxis)
    b = rs.PlaneFromFrame(a[0],xaxis, yaxis)
    pts = []
    pts_id = []
    for j in range(flen):
        d = gc.Orient(a[j],b,rg.Plane.WorldXY)[0]
        pts.append(rg.Point3d(round(d[0], round_num),round(d[1], round_num),round(d[2], round_num)))
        pid = F[i][j]
        refV.append(pid)
        pts_id.append(pid)
    #devF.append(rg.MeshFace(pts_id[0],pts_id[1],pts_id[2]))
    if flen == 3:
        devF.append(rg.MeshFace(0,1,2))
    elif flen == 4:
        devF.append(rg.MeshFace(0,1,2,3))
    return pts
        
def FaceDev_(mesh, f1, f2, devV, devF, refV, refF):
        """"
        f1をもとにf2をxy平面に展開する
        前提として，f1はすでにxy平面に展開されており，もとのメッシュのfaceの接続グラフから，
        共通の頂点２つを導き，この頂点と辺をもとに展開する．
        """
        V = mesh.Vertices
        F = mesh.Faces
        flen1 = 3 if F[f1].IsTriangle else 4
        flen2 = 3 if F[f2].IsTriangle else 4
        fpts2 = []
        for i in range(flen2):
            fpts2.append(V[F[f2][i]])
        e = GetVertexPairTwoConnectedFaces(mesh, f1, f2)
        xaxis2 = rg.Vector3d.Subtract(rs.coerce3dvector(V[e.I]),rs.coerce3dvector(V[e.J]))
        zaxis2 = gc.FaceNormals(mesh)[1][f2]
        yaxis2 = rs.VectorCrossProduct(zaxis2,xaxis2)
        plan2 = rs.PlaneFromFrame(V[e.J],xaxis2, yaxis2)

        f_plane = devF[refF.index(f1)]
        for i in range(flen1):
            if refV[f_plane[i]] == e.I:
                eI = f_plane[i]
            elif refV[f_plane[i]] == e.J:
                eJ = f_plane[i]
                
        #print(rg.Point3d(round(devV[eI][0], round_num),round(devV[eI][1], round_num),round(devV[eI][2], round_num)))
        
        xaxis1 = rg.Vector3d.Subtract(rs.coerce3dvector(devV[eI]),rs.coerce3dvector(devV[eJ]))
        zaxis1 = rg.Vector3d.ZAxis
        yaxis1 = rs.VectorCrossProduct(zaxis1,xaxis1)
        plan1 = rs.PlaneFromFrame(devV[eJ],xaxis1, yaxis1)
        
        pts = []
        pts_id = []
        ref_pt = []
        j = 0
        for i in range(flen2):
            pt = gc.Orient(fpts2[i],plan2,plan1)[0]
            pt[2] = 0
            print(pt[2])
            pt = rg.Point3d(round(pt[0], round_num),round(pt[1], round_num),round(pt[2], round_num))
            if pt in devV:
                pts_id.append(devV.index(pt))
            else:
                pts.append(pt)
                pts_id.append(len(devV) + j)
                ref_pt.append(F[f2][i])
                j += 1
        #print(pts_id)
        if flen2 == 3:
            face = rg.MeshFace(pts_id[0],pts_id[1],pts_id[2])
        elif flen2 == 4:
            face = rg.MeshFace(pts_id[0],pts_id[1],pts_id[2],pts_id[3])
        #face = rg.MeshFace(pts_id[0],pts_id[1],pts_id[2])
        
        
        devF.append(face)
        refF.append(f2)
        devV = devV + pts
        for i in range(len(ref_pt)):
            refV.append(ref_pt[i])
        #print(face)
        return devV
    
def GraphFaceDevelop(mesh,graph,sigma):
    devmeshes = []
    refFs = []
    
    for tree in graph:
        devV = []
        devF = []
        
        sptree_sigma = tree
        
        sptree = []
        for e in sptree_sigma.edges:
            sptree.append([sigma.index(e[0]), sigma.index(e[1])])
        print(sptree)
        root = sptree[0][0]
        
        refV = []   #新しく追加された点がoriginal meshのどの頂点だったか
        refF = []
        
        sortTree = TreeSort(sptree, root, mesh.Vertices.Count)
            
        devV = devV + FaceDev0(mesh, root, refV, devF)
        refF.append(root)
        
        #print(refV,refF)
        
        for e in sortTree:
            devV = FaceDev_(mesh, e[0], e[1], devV, devF, refV, refF)
            if devV == False:
                break
        print(devV)
        net = gc.ConstructMesh(devV, devF)
        devmeshes.append(net)
        refFs.append(refF)
    return devmeshes, refFs

def main(mesh, nmax):
    #meshweldverticesを入れる必要があるかも(boxは頂点がバラバラ)
    mesh.UnifyNormals()
    devFaces = mesh.Faces
    V = mesh.Vertices
    devPts = []
    Vid = []
    
    for i in range(V.Count):
        devPts.append(rg.Point3d.Origin)
        Vid.append(i)
    
    FAG = GetFAG(mesh)
    #print(FAG.edges)
    #print(FAG.vertices)
    Graphs  = []
    mesh_sptree, sortGraph, sigma = EnumSPTrees(FAG, nmax)#本当はEnumSPTreesを書き換える必要がある（計算量が多すぎて動かないので全域木を一つだけ選択している）
    for tree in mesh_sptree:
        tree_edge = tree.edges
        e_modified = []
        for e in tree_edge:
            e_modified.append([sigma.index(e[0]), sigma.index(e[1])])
        Graphs.append(e_modified)
    #print(Graphs[15])
    #print(g.vertices)
    #print(g.edges)
    for i in range(len(sigma)):
        #print('sigma[{}] = {}'.format(i,sigma[i]))
        pass
    #id = id % len(mesh_sptree)
    devmeshes, refFs = GraphFaceDevelop(mesh, mesh_sptree, sigma)
    return devmeshes, refFs, Graphs
    #return GraphFaceDevelop(mesh, [mesh_sptree[0]], sigma)
    
    

if __name__ == "__main__":
    res = main(mesh,max_len_tree)
    #print(res)
    result = res[0]
    refF = res[1]
    tmp = res[2]
                
    #tmp = gt.list_to_tree(tmp)

    #test1 = res[1]
    #test2 = res[2]
# ---------- end enum_net ----------
panel_2 = Panel(enum_net.tmp)
# 頂点を修正したメッシュをここに入力
# これは今の（index = 32）のfid=2と5の
# あたりに点がズレて他の点だと認識され
# ているのを修正するためのプログラム
# この場合だとプログラム内で2-5という面接続がない
mesh_14 = Mesh(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)
item = ListItem(List=enum_net.result, Index=number_slider_3, Wrap=True)
delete_overlap = GhPythonScript(mesh=mesh_14)  # -> out, result; inputs mesh: Mesh
# ---------- delete_overlap: Python ----------
from ghpythonlib.componentbase import executingcomponent as component
import ghpythonlib.components as gc
import Grasshopper, GhPython
import System
import Rhino.Geometry as rg
import rhinoscriptsyntax as rs
import math
import sys
import copy
            
from Grasshopper.Kernel.Data import GH_Path
from Grasshopper import DataTree


x_3d = rg.Vector3d(1,0,0)
x_2d = rg.Vector2d(1,0)
x_3f = rg.Vector3f(1,0,0)
x_2f = rg.Vector2f(1,0)
y_3d = rg.Vector3d(0,1,0)
y_2d = rg.Vector2d(0,1)
y_3f = rg.Vector3f(0,1,0)
y_2f = rg.Vector2f(0,1)

round_num = 2

# -------------------------------- Crane Function------------------------------------------------
def GetVertexPairTwoConnectedFaces(mesh, f1, f2):
    """
    Parameters
    mesh Type:Rhino.Geometry.Mesh
    f1   Type:System.Int32
         The first face index.
    f2   Type:System.Int32
         The second face index.
    """
    E1 = []
    E2 = []
    F1 = mesh.TopologyEdges.GetEdgesForFace(f1)
    F2 = mesh.TopologyEdges.GetEdgesForFace(f2)
    VF1 = []
    VF2 = []
    for i in F1:
        VF1.append(mesh.TopologyEdges.GetTopologyVertices(i))
    for i in F2:
        VF2.append(mesh.TopologyEdges.GetTopologyVertices(i))
    for i in VF1:
         for j in VF2:
             if i[0] in j:
                 if i[1] in j:
                     return i


def TreeSort(tree, root, count):
    max = 1
    i = 0
    pts = []
    sorted = []
    for j in range(len(tree)):
        e = tree[j-i]
        if root in e:
            i += 1
            if e[0] != root:
                pts.append(e[0])
                sorted.append([root, e[0]])
                tree.remove(e)
            else:
                pts.append(e[1])
                sorted.append([root, e[1]])
                tree.remove(e)
    while (len(pts) != 0):
        pts2 = []
        for v in pts:
            i = 0
            for j in range(len(tree)):
                e = tree[j-i]
                if v in e:
                    i += 1
                    if e[0] != v:
                        pts2.append(e[0])
                        sorted.append([v,e[0]])
                        tree.remove(e)
                    else:
                        pts2.append(e[1])
                        sorted.append([v,e[1]])
                        tree.remove(e)
        pts = pts2
    return sorted
# -------------------------------- Liner Algebla ------------------------------------------------
def transposeMatrix(m):
    return map(list,zip(*m))

def getMatrixMinor(m,i,j):
    return [row[:j] + row[j+1:] for row in (m[:i]+m[i+1:])]

def getMatrixDeternminant(m):
    #base case for 2x2 matrix
    if len(m) == 2:
        return m[0][0]*m[1][1]-m[0][1]*m[1][0]

    determinant = 0
    for c in range(len(m)):
        determinant += ((-1)**c)*m[0][c]*getMatrixDeternminant(getMatrixMinor(m,0,c))
    return determinant

def getMatrixInverse(m):
    determinant = getMatrixDeternminant(m)
    #special case for 2x2 matrix:
    if len(m) == 2:
        return [[m[1][1]/determinant, -1*m[0][1]/determinant],
                [-1*m[1][0]/determinant, m[0][0]/determinant]]

    #find matrix of cofactors
    cofactors = []
    for r in range(len(m)):
        cofactorRow = []
        for c in range(len(m)):
            minor = getMatrixMinor(m,r,c)
            cofactorRow.append(((-1)**(r+c)) * getMatrixDeternminant(minor))
        cofactors.append(cofactorRow)
    cofactors = transposeMatrix(cofactors)
    for r in range(len(cofactors)):
        for c in range(len(cofactors)):
            cofactors[r][c] = cofactors[r][c]/determinant
    return cofactors

def CrossProduct2D(v1,v2):
    if type(v1) != 'Vector2d':
        v1 = rg.Vector2d(v1[0],v1[1])
    if type(v2) != 'Vector2d':
        v2 = rg.Vector2d(v2[0],v2[1])
    return (v1.X*v2.Y)-(v1.Y*v2.X)
    
def CrossProduct3D(v1,v2):
    return v1.CrossProduct(v1,v2)
    
# -------------------------------- Primitive Geometry -------------------------------------------
def middlepoint(line):
    p1 = line.From
    p2 = line.To
    return (p1+p2)/2
    




# -------------------------------- Computation on FAG -------------------------------------------
class graph(object):
    def __init__(self, vertices, edges):
        self.edges = edges
        self.vertices = vertices
    def set_edges(self, edges):
        self.edges = edges
    def set_vertices(self, vertices):
        self.vertices = vertices
    def print_edges(self):
        print(self.edges)
    def print_vertices(self):
        print(self.vertices)

def firsttree(G):
    vflag = [0]*len(G.vertices)
    sptree = []
    for e in G.edges:
        if sum(vflag) == len(G.vertices):
            break
        if vflag[e[0]] == 0 or vflag[e[1]] == 0:
            sptree.append(e)
            vflag[e[0]] = 1
            vflag[e[1]] = 1
    return sptree

def dfstree(origV,origE,V,E,Vflag,vnow):
    ecan = []
    for e in origE:
        if vnow in e:
            ecan.append(e)
    for e in ecan:
        if e[0] == vnow:
            partialv = e[1]
        else:
            partialv = e[0]
        if Vflag[partialv] != 1:
            Vflag[partialv]= 1
            V.append(partialv)
            E.append(e)
            dfstree(origV,origE,V,E,Vflag, partialv)
    return 

def myindex(l,item):
    if item in l:
        return l.index(item)
    else:
        return -1

def Sigma(newV):
    sigma = [0] *len(newV)
    for i,v in enumerate(newV):
        sigma[v] = i
    return sigma


def  mergesort_edge(lst):
    if  len(lst) <= 1:
        return lst
    mid = len(lst) // 2
    # ここで分割を行う
    left = lst[:mid]
    right = lst[mid:]
    left = mergesort_edge(left)
    right = mergesort_edge(right)
    return merge_edge(left,right)

def merge_edge(left,right):
    merged = []
    l_i, r_i = 0,0
    while l_i < len(left) and r_i < len(right):
        # ここで=をつけることで安定性を保っている
        if min(left[l_i]) < min(right[r_i]):
            merged.append(left[l_i])
            l_i += 1
        elif min(left[l_i]) > min(right[r_i]):
            merged.append(right[r_i])
            r_i += 1
        else:
            #これはminが同じだった場合で，エッジのもう一端で判別
            if max(left[l_i]) < max(right[r_i]):
                merged.append(left[l_i])
                l_i += 1
            elif max(left[l_i]) > max(right[r_i]):
                merged.append(right[r_i])
                r_i += 1
    if l_i < len(left):
        merged.extend(left[l_i:])
    if r_i < len(right):
        merged.extend(right[r_i:])
    return merged


def sortT0(tree):
    V = [i for i in range(len(tree.vertices))]
    E = []
    sigma = Sigma(tree.vertices)
    for i,e in enumerate(tree.edges):
        E.append([sigma[e[0]],sigma[e[1]]])
    t0 = graph(V,E)
    return t0,sigma

def sortVandE(origE,t0,sigma):
    allE = []
    for i,e in enumerate(origE):
        allE.append([sigma[e[0]],sigma[e[1]]])
    EnotT0 = []
    for i,e in enumerate(allE):
        if e not in t0.edges:
            EnotT0.append(e)
    EsortnotT0 = mergesort_edge(EnotT0)
    Esorted = t0.edges+EsortnotT0
    sorted_gragh = graph(t0.vertices, Esorted)
    return sorted_gragh

def GraphConnection(G,targetgraph):
    Connection = [[] for i in range(len(G.vertices))]
    for i,e in enumerate(targetgraph.edges):
        Connection[e[0]].append(e)
        Connection[e[1]].append(e)
    return Connection

def recrusive_Vsearch(vnow,vprev,EdgeConnection,Vs):
    es = EdgeConnection[vnow]
    if len(es) == 1:
        Vs.append(vnow)
        return 
    Vs.append(vnow)
    for e in es:
        if myindex(e, vprev) == -1:
            if e[0] == vnow:
                vnext = e[1]
            else:
                vnext = e[0]
            recrusive_Vsearch(vnext,vnow,EdgeConnection,Vs)
    return Vs

def search_two_components(T,ek,G):
    v1 = min(ek)
    v2 = max(ek)
    treeconnection = GraphConnection(G,T)
    V1 = []
    recrusive_Vsearch(v1, v2, treeconnection, V1)
    V2 = list(set(V1)^set(T.vertices))
    return V1,V2

def Cut(T, ek, G):
    cut = []
    origGConnection = GraphConnection(G,G)
    V1, V2 = search_two_components(T,ek,G)
    for i,v in enumerate(V1):
        for j,e in enumerate(origGConnection[v]):
            if e not in T.edges:
                if e[0] == v:
                    vcon = e[1]
                else:
                    vcon = e[0]
                if vcon in V2:
                    cut.append(myindex(G.edges,e))
    cut.append(myindex(G.edges,ek))
    return cut

def Entr(Tp,T0,ek,G):
    CutT0 = Cut(T0, ek, G)
    CutTp = Cut(Tp, ek, G)
    entrys = list((set(CutT0)&set(CutTp)))
    entrys.remove(myindex(G.edges,ek))
    return entrys

def find_children(Tp,T0,k, G, sptree):#Entrを使う方で実装．全てのV,EのインデックスはソートされたGに基づいたインデックスになるように注意
    if k < 0:
        return 
    if len(sptree) >= 60:
        return 
    ek = G.edges[k]
    g_list = Entr(Tp, T0, ek, G)
    for i,g in enumerate(g_list):
        ek_id_inTp = myindex(Tp.edges, ek)
        g_id_inTp = myindex(Tp.edges, g)
        Ec = copy.deepcopy(Tp.edges)
        Ec.pop(ek_id_inTp)
        Ec.append(G.edges[g])
        Tc = graph(G.vertices,Ec)
        sptree.append(Tc)
        find_children(Tc,T0, k-1, G, sptree)
    find_children(Tp, T0, k-1, G, sptree)

def EnumSPTrees(origG): #G=[V,E]
    origV = origG.vertices
    #print(origV)
    origE = origG.edges
    #print(origE)
    V = []
    E = []
    Vflag = [-1] * len(origV)
    Vflag[0] = 1
    V.append(origV[0])
    dfstree(origV,origE,V,E,Vflag, origV[0])
    t0 = graph(V,E)
    # print(t0)
    s = sortT0(t0)
    T0 = s[0]
    # print(T0)
    sigma = s[1]
    G= sortVandE(origE,T0,sigma)
    #return G
    
    EdgeConnection = GraphConnection(G,G)

    SpTree = [T0]
    find_children(T0, T0, (len(G.vertices)-1)-1,G, SpTree)
    return SpTree, G, sigma




class HalfEdge(object):
        def __init__(self,v):
            self.next = None
            self.prev = None
            self.vertex = v
            if v.he == None:
                v.he = self
            self.face = None
            self.pair = None
            
        def set_next(self,he_next):
            self.next = he_next
        def set_prev(self,he_prev):
            self.prev = he_prev
        def set_pair(self,he_pair):
            self.prev = he_pair
        def set_face(self,face):
            self.face = face
            if face.he == None:
                face.he = self

class HEFace(object):
    def __init__(self):
        self.he = None
class HEVertex(object):
    def __init__(self,v):
        self.v = v
        self.he = None
def setHalfEdgePair(HEs):
    for he_search in HEs:
        #print('search={} to {}'.format(he_search.vertex.v, he_search.next.vertex.v))
        for he_cand in HEs:
            #print('cand={} to {}'.format(he_cand.vertex.v, he_cand.next.vertex.v))
            if he_search.next.vertex == he_cand.vertex and he_search.vertex == he_cand.next.vertex:
                if he_search.pair == None:
                    he_search.pair = he_cand
                if he_cand.pair == None:
                    he_cand.pair = he_search      
                    
                    
def ConstructHalfEdge(MeshV,MeshF):
    #print(type(MeshF))
#     def __init__(self,MeshV,MeshF):
    Faces = []
    Vertices = []
    for mvid, mv in enumerate(MeshV):
        Vertices.append(HEVertex(mv))#consrtuct v, halfedge is null
    #print(Vertices)
    Halfedges = []
    for mfid, mf in enumerate(MeshF):
        face = HEFace() #construct f, halfedge is null
        Faces.append(face)
        if mf.IsTriangle:
            mvids = [mf.A, mf.B, mf.C]
        else:
            mvids = [mf.A, mf.B, mf.C, mf.D]   #すべてのfaceがrectangleであるという前提に基づいている
        hes = []
        for i in range(len(mvids)):
            v = Vertices[mvids[i]]#mesh vertex and vertex of halfedge have same corrdinates for same id
            he = HalfEdge(v)
            hes.append(he)
        for i,he in enumerate(hes):
            if i == len(hes)-1:
                he.set_next(hes[0])
                he.set_prev(hes[i-1])
            else:
                he.set_next(hes[i+1])
                he.set_prev(hes[i-1])
            he.set_face(face)
            Halfedges.append(he)

    setHalfEdgePair(Halfedges)
    
    return Vertices, Faces, Halfedges
    
    
def GetFAG(mesh):
    v = mesh.Vertices
    f = mesh.Faces
    HEV,HEF, HE = ConstructHalfEdge(v,f)
    FAG_node = [fid for fid in range(len(HEF))]
    #print('FAG_node={}'.format(FAG_node))
    FAG_edge = []
    for he in HE:
        try:
            facepair = [HEF.index(he.face), HEF.index(he.pair.face)]
            if facepair[0] != facepair[1]:
                if facepair not in FAG_edge and facepair[::-1] not in FAG_edge:
                    FAG_edge.append(facepair)
        except:
            pass
    FAG = graph(FAG_node,FAG_edge)
    return FAG
    
    
    
# -----------------------------------------------------------------------------------------------
def FaceDev0(M, i, refV, devF):
    """"
    まずi番目(実際はroot)のfaceをxy平面に展開する
    これはsptreeをrootからの順番でソートしているから可能
    """
    V = M.Vertices
    F = M.Faces
    flen = 3 if F[i].IsTriangle else 4
    a = []
    for j in range(flen):
        a.append(V[F[i][j]])
    xaxis = rg.Vector3d.Subtract(rs.coerce3dvector(a[1]),rs.coerce3dvector(a[0]))
    zaxis = gc.FaceNormals(M)[1][i]
    yaxis = rs.VectorCrossProduct(zaxis,xaxis)
    b = rs.PlaneFromFrame(a[0],xaxis, yaxis)
    pts = []
    pts_id = []
    for j in range(flen):
        d = gc.Orient(a[j],b,rg.Plane.WorldXY)[0]
        pts.append(rg.Point3d(round(d[0], round_num),round(d[1], round_num),round(d[2], round_num)))
        pid = F[i][j]
        refV.append(pid)
        pts_id.append(pid)
    #devF.append(rg.MeshFace(pts_id[0],pts_id[1],pts_id[2]))
    if flen == 3:
        devF.append(rg.MeshFace(0,1,2))
    elif flen == 4:
        devF.append(rg.MeshFace(0,1,2,3))
    return pts
        
def FaceDev_(mesh, f1, f2, devV, devF, refV, refF):
    try:
        """"
        f1をもとにf2をxy平面に展開する
        前提として，f1はすでにxy平面に展開されており，もとのメッシュのfaceの接続グラフから，
        共通の頂点２つを導き，この頂点と辺をもとに展開する．
        """
        V = mesh.Vertices
        F = mesh.Faces
        flen = 3 if F[f2].IsTriangle else 4
        fpts2 = []
        for i in range(flen):
            fpts2.append(V[F[f2][i]])
        e = GetVertexPairTwoConnectedFaces(mesh, f1, f2)
        
        xaxis2 = rg.Vector3d.Subtract(rs.coerce3dvector(V[e.I]),rs.coerce3dvector(V[e.J]))
        zaxis2 = gc.FaceNormals(mesh)[1][f2]
        yaxis2 = rs.VectorCrossProduct(zaxis2,xaxis2)
        plan2 = rs.PlaneFromFrame(V[e.J],xaxis2, yaxis2)

        f_plane = devF[refF.index(f1)]
        for i in range(flen):
            if refV[f_plane[i]] == e.I:
                eI = f_plane[i]
            elif refV[f_plane[i]] == e.J:
                eJ = f_plane[i]
                
        #print(rg.Point3d(round(devV[eI][0], round_num),round(devV[eI][1], round_num),round(devV[eI][2], round_num)))
        
        xaxis1 = rg.Vector3d.Subtract(rs.coerce3dvector(devV[eI]),rs.coerce3dvector(devV[eJ]))
        zaxis1 = rg.Vector3d.ZAxis
        yaxis1 = rs.VectorCrossProduct(zaxis1,xaxis1)
        plan1 = rs.PlaneFromFrame(devV[eJ],xaxis1, yaxis1)
        
        pts = []
        pts_id = []
        ref_pt = []
        j = 0
        for i in range(flen):
            pt = gc.Orient(fpts2[i],plan2,plan1)[0]
            pt = rg.Point3d(round(pt[0], round_num),round(pt[1], round_num),round(pt[2], round_num))
            if pt in devV:
                pts_id.append(devV.index(pt))
            else:
                pts.append(pt)
                pts_id.append(len(devV) + j)
                ref_pt.append(F[f2][i])
                j += 1
        #print(pts_id)
        if flen == 3:
            face = rg.MeshFace(pts_id[0],pts_id[1],pts_id[2])
        elif flen == 4:
            face = rg.MeshFace(pts_id[0],pts_id[1],pts_id[2],pts_id[3])
        #face = rg.MeshFace(pts_id[0],pts_id[1],pts_id[2])
        
        
        devF.append(face)
        refF.append(f2)
        devV = devV + pts
        for i in range(len(ref_pt)):
            refV.append(ref_pt[i])
        #print(face)
        return devV
    except:
        pass
    
def GraphFaceDevelop(mesh,graph,sigma):
    devmeshes = []
    
    for tree in graph:
        devV = []
        devF = []
        
        sptree_sigma = tree
        
        sptree = []
        for e in sptree_sigma.edges:
            sptree.append([sigma.index(e[0]), sigma.index(e[1])])
        #print(sptree)
        root = sptree[0][0]
        
        refV = []   #新しく追加された点がoriginal meshのどの頂点だったか
        refF = []
        
        sortTree = TreeSort(sptree, root, mesh.Vertices.Count)
            
        devV = devV + FaceDev0(mesh, root, refV, devF)
        refF.append(root)
        
        #print(refV,refF)
        
        for e in sortTree:
            devV = FaceDev_(mesh, e[0], e[1], devV, devF, refV, refF)
            if devV == False:
                break
        net = gc.ConstructMesh(devV, devF)
        devmeshes.append(net)
    return devmeshes

def main(mesh):
    dl = ((gc.BoundingBox(mesh)[0]).BoundingBox.Diagonal).Length
    print(dl)
    #meshweldverticesを入れる必要があるかも(boxは頂点がバラバラ)
    mesh.UnifyNormals()
    devFaces = mesh.Faces
    V = mesh.Vertices
    F = mesh.Faces
    
    overlap = []
    overlap0 = []
    for i,vi in enumerate(V):
        for j,vj in enumerate(V):
            if i <= j :
                break
            if gc.Distance(vi,vj) <= dl/500:
                overlap.append([i,j])
                overlap0.append(i)
    print(overlap0)
    
    replaced = []
    deleted = []
    for i, itemi in enumerate(overlap0):
        for j, itemj in enumerate(overlap0):
            if i <= j :
                break
            if i!=j and itemi == itemj:
                print(i,j)
                if overlap[i][1] > overlap[j][1]:
                    deleted.append(i)
                else:
                    deleted.append(j)
    for i in range(len(deleted)):
        del overlap[deleted[i] - i]
    print(overlap)
    
    #overlapの数だけVの数が減る、つまり、全てのVidがlen(overlap)だけマイナス
    #Faceのoverlap[0](indexが大きい方)を置換
    sub = len(overlap)
    replaced = []
    for i in range(len(overlap)):
        replaced.append(overlap[i][0])
        
    print(replaced)
    
    
    sublist = [sub] * len(V)
    for i in range(len(replaced)):
        for j in range(len(V)):
            if j >= replaced[i]:
                break
            sublist[j] -= 1
            
        
    Faces = []
    for i in range(F.Count):
        f = F[i]
        flen = 3 if F[i].IsTriangle else 4
        if flen == 3:
            vids = [f.A, f.B, f.C]
        else:
            vids = [f.A, f.B, f.C, f.D]
        for i,id in enumerate(vids):
            if id in replaced:
                vids[i] = overlap[replaced.index(id)][1] - sublist[overlap[replaced.index(id)][1]]
            else:
                vids[i] = id - sublist[id]
        if flen == 3:
            face = (rg.MeshFace(vids[0],vids[1],vids[2])) 
        else:
            face = (rg.MeshFace(vids[0],vids[1],vids[2],vids[3]))
        Faces.append(face)
        print(f, face)
            
    Vertices = []
    for i,v in enumerate(V):
        if i in replaced:
            pass
        else:
            Vertices.append(v)
    
    return gc.ConstructMesh(Vertices, Faces)
        
            
            
                
    print(overlap)
    return overlap
            
            
    
    devPts = []
    Vid = []
    
    for i in range(V.Count):
        devPts.append(rg.Point3d.Origin)
        Vid.append(i)
    
    return 
    #return GraphFaceDevelop(mesh, [mesh_sptree[0]], sigma)
    
    

if __name__ == "__main__":
    res = main(mesh)
    #print(res)
    result = res
    #test1 = res[1]
    #test2 = res[2]
# ---------- end delete_overlap ----------
dam_2 = DataDam(DataA=dam, DataB=item, BufferDelay=10000000, BufferMode=0)  # -> DataA, DataB
item_2 = ListItem(List=enum_net.refF, Index=number_slider_3, Wrap=True)

# ----
# width of air path
number_slider_4 = Slider(7, range=7..20)

# ----
# aspect ratio of pouch
aspect_ratio = Slider(8, range=4..10)

preview = CustomPreview(
    Geometry=dam_2.DataB,
    Material={diffuse=RGB(228, 178, 227), emission=RGB(68, 53, 68), shine=0.5, specular=RGB(255, 254, 254), transparency=0})

# ----
# 空気口
python = GhPythonScript(mesh=dam, refF_list=enum_net.refF, id=number_slider_3)  # -> out, refF; inputs mesh: list of Mesh, refF_list: list, id: list of Int32
# ---------- python: Python ----------
__author__ = "kazuki"

import rhinoscriptsyntax as rs
import ghpythonlib.treehelpers as gt

refF = []
if len(refF_list) == mesh[0].Faces.Count and isinstance(refF_list[0][0], int):
    refF = refF_list
else:
    id = id[0] % len(refF_list)
    refF = refF_list[id]
    print(refF)
    #refF = gt.list_to_tree(refF)
# ---------- end python ----------
item_3 = ListItem(List=enum_net.result, Index=number_slider_3, Wrap=True)
python_2 = GhPythonScript(graph_list=enum_net.tmp, refF=python.refF, id=number_slider_3)  # -> out, graph; inputs graph_list: list, refF: list, id: list of Int32
# ---------- python_2: Python ----------
__author__ = "kazuki"

import rhinoscriptsyntax as rs
import ghpythonlib.treehelpers as gt

graph = []
print(graph_list[id[0]])
for i, e in enumerate(graph_list[id[0]]):
    graph.append([refF.index(e[0]), refF.index(e[1])])
    #graph.append([refF[e[0]], refF[e[1]]])
print(graph)
#graph = gt.list_to_tree(graph)
# ---------- end python_2 ----------
python_3 = GhPythonScript(mesh2d=item_3, refF=python.refF)  # -> out, FaceID_modified_mesh; inputs mesh2d: Mesh, refF: list; disabled
# ---------- python_3: Python ----------
__author__ = "kazuki"

import rhinoscriptsyntax as rs
import ghpythonlib.treehelpers as gt
import ghpythonlib.components as gc


Face_list = []
print(refF)
for i in range(mesh2d.Faces.Count):
    Face_list.append(mesh2d.Faces[refF[i]])

FaceID_modified_mesh = gc.ConstructMesh(mesh2d.Vertices, Face_list, 0)
# ---------- end python_3 ----------
minimax_depth = GhPythonScript(graph=python_2.graph)  # -> out, entrance_faces; inputs graph: list
# ---------- minimax_depth: Python ----------
__author__ = "kazuki"

import rhinoscriptsyntax as rs
import ghpythonlib.treehelpers as gt


def edges_to_adjacency_list(edges):
    # エッジのリストから隣接リストを作成します
    tree = dict()
    for edge in edges:
        if edge[0] not in tree:
            tree[edge[0]] = []
        if edge[1] not in tree:
            tree[edge[1]] = []
        tree[edge[0]].append(edge[1])
        tree[edge[1]].append(edge[0])
    return tree

def find_tree_center(tree):
    n = len(tree)
    degree = [0]*n
    leaves = []

    for i in range(n):
        degree[i] = len(tree[i])
        if degree[i] == 1:
            leaves.append(i)

    removed_leaves = 0
    while removed_leaves < n:
        new_leaves = []
        for node in leaves:
            removed_leaves += 1
            degree[node] -= 1
            for neighbor in tree[node]:
                degree[neighbor] -= 1
                if degree[neighbor] == 1:
                    new_leaves.append(neighbor)

        if removed_leaves == n:
            return leaves

        leaves = new_leaves

tree = edges_to_adjacency_list(graph)
entrance_faces = find_tree_center(tree)
print(entrance_faces)
# ---------- end minimax_depth ----------
panel_3 = Panel(minimax_depth.entrance_faces)

dam_3 = DataDam(
    DataA=dam_2.DataA,
    DataB=dam_2.DataB,
    DataC=aspect_ratio,
    DataD=Slider(0, range=0..5),
    DataE=number_slider_4,
    DataF=item_2,
    BufferDelay=10000000,
    BufferMode=0)  # -> DataA, DataB, DataC, DataD, DataE, DataF
pouchandpanel = GhPythonScript(
    mesh3D=dam_3.DataA,
    mesh2D=dam_3.DataB,
    as_ratio=dam_3.DataC,
    offset_doublehinge=dam_3.DataD,
    airpath_width=dam_3.DataE,
    refF=dam_3.DataF)  # -> out, flatten(frontpanel), flatten(backpanel), flatten(pouch), flatten(front_visualization), flatten(back_visualization), protrudes, airpath, airpath_double, tmp; inputs mesh3D: Mesh, mesh2D: Mesh
# ---------- pouchandpanel: Python ----------
from ghpythonlib.componentbase import executingcomponent as component
import ghpythonlib.components as gc
import Grasshopper, GhPython
import System
import Rhino.Geometry as rg
import rhinoscriptsyntax as rs
import math
import sys
import copy
import ghpythonlib.treehelpers as gt
import warnings
from collections import defaultdict
            
from Grasshopper.Kernel.Data import GH_Path
from Grasshopper import DataTree


x_3d = rg.Vector3d(1,0,0)
x_2d = rg.Vector2d(1,0)
x_3f = rg.Vector3f(1,0,0)
x_2f = rg.Vector2f(1,0)
y_3d = rg.Vector3d(0,1,0)
y_2d = rg.Vector2d(0,1)
y_3f = rg.Vector3f(0,1,0)
y_2f = rg.Vector2f(0,1)

round_num = 2

div_num = 5

# -------------------------------- Crane Function------------------------------------------------
def GetVertexPairTwoConnectedFaces(mesh, f1, f2):
    """
    Parameters
    mesh Type:Rhino.Geometry.Mesh
    f1   Type:System.Int32
         The first face index.
    f2   Type:System.Int32
         The second face index.
    """
    E1 = []
    E2 = []
    F1 = mesh.TopologyEdges.GetEdgesForFace(f1)
    F2 = mesh.TopologyEdges.GetEdgesForFace(f2)
    VF1 = []
    VF2 = []
    for i in F1:
        VF1.append(mesh.TopologyEdges.GetTopologyVertices(i))
    for i in F2:
        VF2.append(mesh.TopologyEdges.GetTopologyVertices(i))
    for i in VF1:
         for j in VF2:
             if i[0] in j:
                 if i[1] in j:
                     return i



# -------------------------------- Liner Algebla ------------------------------------------------
def transposeMatrix(m):
    return map(list,zip(*m))

def getMatrixMinor(m,i,j):
    return [row[:j] + row[j+1:] for row in (m[:i]+m[i+1:])]

def getMatrixDeternminant(m):
    #base case for 2x2 matrix
    if len(m) == 2:
        return m[0][0]*m[1][1]-m[0][1]*m[1][0]

    determinant = 0
    for c in range(len(m)):
        determinant += ((-1)**c)*m[0][c]*getMatrixDeternminant(getMatrixMinor(m,0,c))
    return determinant

def getMatrixInverse(m):
    determinant = getMatrixDeternminant(m)
    #special case for 2x2 matrix:
    if len(m) == 2:
        return [[m[1][1]/determinant, -1*m[0][1]/determinant],
                [-1*m[1][0]/determinant, m[0][0]/determinant]]

    #find matrix of cofactors
    cofactors = []
    for r in range(len(m)):
        cofactorRow = []
        for c in range(len(m)):
            minor = getMatrixMinor(m,r,c)
            cofactorRow.append(((-1)**(r+c)) * getMatrixDeternminant(minor))
        cofactors.append(cofactorRow)
    cofactors = transposeMatrix(cofactors)
    for r in range(len(cofactors)):
        for c in range(len(cofactors)):
            cofactors[r][c] = cofactors[r][c]/determinant
    return cofactors

def CrossProduct2D(v1,v2):
    if type(v1) != 'Vector2d':
        v1 = rg.Vector2d(v1[0],v1[1])
    if type(v2) != 'Vector2d':
        v2 = rg.Vector2d(v2[0],v2[1])
    return (v1.X*v2.Y)-(v1.Y*v2.X)
    
def CrossProduct3D(v1,v2):
    return v1.CrossProduct(v1,v2)

def GetFoldingAngles(mesh):
    rho = []
    vert = rs.MeshVertices(mesh)
    edge_list = GetTopologyInnerEdgesList(mesh)[0]
    face_list = GetTopologyInnerEdgesList(mesh)[1]
    face_center = gc.FaceNormals(mesh)[0]
    for e in range(len(edge_list)):
        rho_e = 0
        i = face_list[e][0]
        j = face_list[e][1]
        normal_i = rs.VectorUnitize(rg.Vector3d(rs.MeshFaceNormals(mesh)[i]))
        normal_j = rs.VectorUnitize(rg.Vector3d(rs.MeshFaceNormals(mesh)[j]))
        center_i = face_center[i]
        center_j = face_center[j]
        center_i_moved = gc.Move(center_i, normal_i)[0]
        line = gc.Line(rs.coerce3dpoint(center_i), rs.coerce3dpoint(center_i_moved))
        # cos(rho_e) = n_i * n_j
        cos_rho_e = rs.VectorDotProduct(normal_i, normal_j)
        # sin(rho_e) = (n_i × n_j) * e
        #sin_rho_e = rs.VectorDotProduct((rs.VectorCrossProduct(normal_i, normal_j)), rs.VectorUnitize(vert[edge_list[e][0]]-vert[edge_list[e][1]]))
        t = gc.CurveClosestPoint(rs.coerce3dpoint(center_j), line)[1]
        if t != 0:
            if cos_rho_e>1.0:
                cos_rho_e = 1.0
            elif cos_rho_e<-1.0:
                cos_rho_e = -1.0
            rho_e = math.acos(cos_rho_e)
        #if sin_rho_e >=0:
        #    rho_e = math.acos(cos_rho_e)
        else:
            if cos_rho_e>1.0:
                cos_rho_e = 1.0
            elif cos_rho_e<-1.0:
                cos_rho_e = -1.0
            rho_e = -1 * math.acos(cos_rho_e)
        rho.append(rho_e)
    return rho
def GetFoldingAngles(mesh, f1, f2):
    face_center = gc.FaceNormals(mesh)[0]
    rho_e = 0
    i = f1
    j = f2
    normal_i = rs.VectorUnitize(rg.Vector3d(rs.MeshFaceNormals(mesh)[i]))
    normal_j = rs.VectorUnitize(rg.Vector3d(rs.MeshFaceNormals(mesh)[j]))
    center_i = face_center[i]
    center_j = face_center[j]
    center_i_moved = gc.Move(center_i, normal_i)[0]
    line = gc.Line(rs.coerce3dpoint(center_i), rs.coerce3dpoint(center_i_moved))
    # cos(rho_e) = n_i * n_j
    cos_rho_e = rs.VectorDotProduct(normal_i, normal_j)
    # sin(rho_e) = (n_i × n_j) * e
    #sin_rho_e = rs.VectorDotProduct((rs.VectorCrossProduct(normal_i, normal_j)), rs.VectorUnitize(vert[edge_list[e][0]]-vert[edge_list[e][1]]))
    t = gc.CurveClosestPoint(rs.coerce3dpoint(center_j), line)[1]
    if t != 0:
        if cos_rho_e>1.0:
            cos_rho_e = 1.0
        elif cos_rho_e<-1.0:
            cos_rho_e = -1.0
        rho_e = math.acos(cos_rho_e)
    #if sin_rho_e >=0:
    #    rho_e = math.acos(cos_rho_e)
    else:
        if cos_rho_e>1.0:
            cos_rho_e = 1.0
        elif cos_rho_e<-1.0:
            cos_rho_e = -1.0
        rho_e = -1 * math.acos(cos_rho_e)
    return rho_e
    
    
def GetTopologyNakedEdgesList(mesh):
    mesh = rs.coercemesh(mesh)
    edge_vert_list = []
    for i in range(mesh.TopologyEdges.Count):
        if len(mesh.TopologyEdges.GetConnectedFaces(i)) == 1:
            edge = []
            edge.append(mesh.TopologyEdges.GetTopologyVertices(i).I)
            edge.append(mesh.TopologyEdges.GetTopologyVertices(i).J)
            edge_vert_list.append(edge)
    return edge_vert_list

def GetTopologyInnerEdgesList(mesh):
    mesh = rs.coercemesh(mesh)
    edge_vert_list = []
    face_vert_list = []
    for i in range(mesh.TopologyEdges.Count):
        if len(mesh.TopologyEdges.GetConnectedFaces(i)) == 2:
            face = []
            edge = []
            edge.append(mesh.TopologyEdges.GetTopologyVertices(i).I)
            edge.append(mesh.TopologyEdges.GetTopologyVertices(i).J)
            face.append(mesh.TopologyEdges.GetConnectedFaces(i)[0])
            face.append(mesh.TopologyEdges.GetConnectedFaces(i)[1])
            edge_vert_list.append(edge)
            face_vert_list.append(face)
    return [edge_vert_list, face_vert_list]
# -------------------------------- Primitive Geometry -------------------------------------------
def middlepoint(line):
    p1 = line.From
    p2 = line.To
    return (p1+p2)/2
def LinesIntersect2D(ln1, ln2):
    ln1end = gc.EndPoints(ln1)
    ln2end = gc.EndPoints(ln2)
    x1 = [ln1end[0][0], ln1end[0][1]]
    x2 = [ln1end[1][0], ln1end[1][1]]
    x3 = [ln2end[0][0], ln2end[0][1]]
    x4 = [ln2end[1][0], ln2end[1][1]]
    x12 = [x2[0]-x1[0], x2[1]-x1[1]]
    x34 = [-x4[0]+x3[0], -x4[1]+x3[1]]
    mat = [x12, x34]
    matInv = getMatrixInverse(mat)
    matInv = transposeMatrix(matInv)
    t = matInv[0][0]*(x3[0]-x1[0]) + matInv[0][1]*(x3[1]-x1[1])
    temp = [x12[0]*t + x1[0], x12[1]*t + x1[1]]
    pt = rs.AddPoint(temp[0], temp[1], 0)
    return pt
def get_angle_atan2(vec1,vec2):
    return math.atan2(CrossProduct2D(vec1,vec2), vec1*vec2)
# -------------------------------- Computation on FAG -------------------------------------------
class graph(object):
    def __init__(self, vertices, edges):
        self.edges = edges
        self.vertices = vertices
    def set_edges(self, edges):
        self.edges = edges
    def set_vertices(self, vertices):
        self.vertices = vertices
    def print_edges(self):
        print(self.edges)
    def print_vertices(self):
        print(self.vertices)

def firsttree(G):
    vflag = [0]*len(G.vertices)
    sptree = []
    for e in G.edges:
        if sum(vflag) == len(G.vertices):
            break
        if vflag[e[0]] == 0 or vflag[e[1]] == 0:
            sptree.append(e)
            vflag[e[0]] = 1
            vflag[e[1]] = 1
    return sptree

def dfstree(origV,origE,V,E,Vflag,vnow):
    ecan = []
    for e in origE:
        if vnow in e:
            ecan.append(e)
    for e in ecan:
        if e[0] == vnow:
            partialv = e[1]
        else:
            partialv = e[0]
        if Vflag[partialv] != 1:
            Vflag[partialv]= 1
            V.append(partialv)
            E.append(e)
            dfstree(origV,origE,V,E,Vflag, partialv)
    return 

def myindex(l,item):
    if item in l:
        return l.index(item)
    else:
        return -1

def Sigma(newV):
    
    sigma = [0] *len(newV)
    for i,v in enumerate(newV):
        sigma[v] = i
    return sigma


def  mergesort_edge(lst):
    if  len(lst) <= 1:
        return lst
    mid = len(lst) // 2
    # ここで分割を行う
    left = lst[:mid]
    right = lst[mid:]
    left = mergesort_edge(left)
    right = mergesort_edge(right)
    return merge_edge(left,right)

def merge_edge(left,right):
    merged = []
    l_i, r_i = 0,0
    while l_i < len(left) and r_i < len(right):
        # ここで=をつけることで安定性を保っている
        if min(left[l_i]) < min(right[r_i]):
            merged.append(left[l_i])
            l_i += 1
        elif min(left[l_i]) > min(right[r_i]):
            merged.append(right[r_i])
            r_i += 1
        else:
            #これはminが同じだった場合で，エッジのもう一端で判別
            if max(left[l_i]) < max(right[r_i]):
                merged.append(left[l_i])
                l_i += 1
            elif max(left[l_i]) > max(right[r_i]):
                merged.append(right[r_i])
                r_i += 1
    if l_i < len(left):
        merged.extend(left[l_i:])
    if r_i < len(right):
        merged.extend(right[r_i:])
    return merged


def sortT0(tree):
    V = [i for i in range(len(tree.vertices))]
    E = []
    sigma = Sigma(tree.vertices)
    for i,e in enumerate(tree.edges):
        E.append([sigma[e[0]],sigma[e[1]]])
    t0 = graph(V,E)
    return t0,sigma

def sortVandE(origE,t0,sigma):
    allE = []
    for i,e in enumerate(origE):
        allE.append([sigma[e[0]],sigma[e[1]]])
    EnotT0 = []
    for i,e in enumerate(allE):
        if e not in t0.edges:
            EnotT0.append(e)
    EsortnotT0 = mergesort_edge(EnotT0)
    Esorted = t0.edges+EsortnotT0
    sorted_gragh = graph(t0.vertices, Esorted)
    return sorted_gragh

def GraphConnection(G,targetgraph):
    Connection = [[] for i in range(len(G.vertices))]
    for i,e in enumerate(targetgraph.edges):
        Connection[e[0]].append(e)
        Connection[e[1]].append(e)
    return Connection

def recrusive_Vsearch(vnow,vprev,EdgeConnection,Vs):
    es = EdgeConnection[vnow]
    if len(es) == 1:
        Vs.append(vnow)
        return 
    Vs.append(vnow)
    for e in es:
        if myindex(e, vprev) == -1:
            if e[0] == vnow:
                vnext = e[1]
            else:
                vnext = e[0]
            recrusive_Vsearch(vnext,vnow,EdgeConnection,Vs)
    return Vs

def search_two_components(T,ek,G):
    v1 = min(ek)
    v2 = max(ek)
    treeconnection = GraphConnection(G,T)
    V1 = []
    recrusive_Vsearch(v1, v2, treeconnection, V1)
    V2 = list(set(V1)^set(T.vertices))
    return V1,V2

def Cut(T, ek, G):
    cut = []
    origGConnection = GraphConnection(G,G)
    V1, V2 = search_two_components(T,ek,G)
    for i,v in enumerate(V1):
        for j,e in enumerate(origGConnection[v]):
            if e not in T.edges:
                if e[0] == v:
                    vcon = e[1]
                else:
                    vcon = e[0]
                if vcon in V2:
                    cut.append(myindex(G.edges,e))
    cut.append(myindex(G.edges,ek))
    return cut

def Entr(Tp,T0,ek,G):
    CutT0 = Cut(T0, ek, G)
    CutTp = Cut(Tp, ek, G)
    entrys = list((set(CutT0)&set(CutTp)))
    entrys.remove(myindex(G.edges,ek))
    return entrys

def find_children(Tp,T0,k, G, sptree):#Entrを使う方で実装．全てのV,EのインデックスはソートされたGに基づいたインデックスになるように注意
    if k < 0:
        return 
    if len(sptree) >= 60:
        return 
    ek = G.edges[k]
    g_list = Entr(Tp, T0, ek, G)
    for i,g in enumerate(g_list):
        ek_id_inTp = myindex(Tp.edges, ek)
        g_id_inTp = myindex(Tp.edges, g)
        Ec = copy.deepcopy(Tp.edges)
        Ec.pop(ek_id_inTp)
        Ec.append(G.edges[g])
        Tc = graph(G.vertices,Ec)
        sptree.append(Tc)
        find_children(Tc,T0, k-1, G, sptree)
    find_children(Tp, T0, k-1, G, sptree)

def EnumSPTrees(origG): #G=[V,E]
    origV = origG.vertices
    origE = origG.edges
    V = []
    E = []
    Vflag = [-1] * len(origV)
    Vflag[0] = 1
    V.append(origV[0])
    dfstree(origV,origE,V,E,Vflag, origV[0])
    t0 = graph(V,E)
    # print(t0)
    s = sortT0(t0)
    T0 = s[0]
    # print(T0)
    sigma = s[1]
    return sigma
    G= sortVandE(origE,T0,sigma)
    #return G
    
    EdgeConnection = GraphConnection(G,G)

    SpTree = [T0]
    find_children(T0, T0, (len(G.vertices)-1)-1,G, SpTree)
    return SpTree, G, sigma




class HalfEdge(object):
    def __init__(self,v):
        self.next = None
        self.prev = None
        self.vertex = v
        if v.he == None:
            v.he = self
        self.face = None
        self.pair = None
        
    def set_next(self,he_next):
        self.next = he_next
    def set_prev(self,he_prev):
        self.prev = he_prev
    def set_pair(self,he_pair):
        self.prev = he_pair
    def set_face(self,face):
        self.face = face
        if face.he == None:
            face.he = self

class HEFace(object):
    def __init__(self):
        self.he = None
class HEVertex(object):
    def __init__(self,v):
        self.v = v
        self.he = None
def setHalfEdgePair(HEs):
    for he_search in HEs:
        #print('search={} to {}'.format(he_search.vertex.v, he_search.next.vertex.v))
        for he_cand in HEs:
            #print('cand={} to {}'.format(he_cand.vertex.v, he_cand.next.vertex.v))
            if he_search.next.vertex == he_cand.vertex and he_search.vertex == he_cand.next.vertex:
                if he_search.pair == None:
                    he_search.pair = he_cand
                if he_cand.pair == None:
                    he_cand.pair = he_search      
                    
                    
def ConstructHalfEdge(MeshV,MeshF):
    #print(type(MeshF))
#     def __init__(self,MeshV,MeshF):
    Faces = []
    Vertices = []
    for mvid, mv in enumerate(MeshV):
        Vertices.append(HEVertex(mv))#consrtuct v, halfedge is null
    #print(Vertices)
    Halfedges = []
    for mfid, mf in enumerate(MeshF):
        face = HEFace() #construct f, halfedge is null
        Faces.append(face)
        if mf.IsTriangle:
            mvids = [mf.A, mf.B, mf.C]
        else:
            mvids = [mf.A, mf.B, mf.C, mf.D]   #すべてのfaceがrectangleであるという前提に基づいている
        hes = []
        for i in range(len(mvids)):
            v = Vertices[mvids[i]]#mesh vertex and vertex of halfedge have same corrdinates for same id
            he = HalfEdge(v)
            hes.append(he)
        for i,he in enumerate(hes):
            if i == len(hes)-1:
                he.set_next(hes[0])
                he.set_prev(hes[i-1])
            else:
                he.set_next(hes[i+1])
                he.set_prev(hes[i-1])
            he.set_face(face)
            Halfedges.append(he)

    setHalfEdgePair(Halfedges)
    
    return Vertices, Faces, Halfedges
    
    
def GetFAG(mesh):
    v = mesh.Vertices
    f = mesh.Faces
    HEV,HEF, HE = ConstructHalfEdge(v,f)
    FAG_node = [fid for fid in range(len(HEF))]
    #print('FAG_node={}'.format(FAG_node))
    FAG_edge = []
    for he in HE:
        try:
            facepair = [HEF.index(he.face), HEF.index(he.pair.face)]
            if facepair[0] != facepair[1]:
                if facepair not in FAG_edge and facepair[::-1] not in FAG_edge:
                    FAG_edge.append(facepair)
        except:
            pass
    FAG = graph(FAG_node,FAG_edge)
    return FAG
    
    
    
# -----------------------------------------------------------------------------------------------
def FaceDev0(M, i, refV, devF):
    """"
    まずi番目(実際はroot)のfaceをxy平面に展開する
    これはsptreeをrootからの順番でソートしているから可能
    """
    V = M.Vertices
    F = M.Faces
    flen = 3 if F[i].IsTriangle else 4
    a = []
    for j in range(flen):
        a.append(V[F[i][j]])
    xaxis = rg.Vector3d.Subtract(rs.coerce3dvector(a[1]),rs.coerce3dvector(a[0]))
    zaxis = gc.FaceNormals(M)[1][i]
    yaxis = rs.VectorCrossProduct(zaxis,xaxis)
    b = rs.PlaneFromFrame(a[0],xaxis, yaxis)
    pts = []
    pts_id = []
    for j in range(flen):
        d = gc.Orient(a[j],b,rg.Plane.WorldXY)[0]
        pts.append(rg.Point3d(round(d[0], round_num),round(d[1], round_num),round(d[2], round_num)))
        pid = F[i][j]
        refV.append(pid)
        pts_id.append(pid)
    #devF.append(rg.MeshFace(pts_id[0],pts_id[1],pts_id[2]))
    if flen == 3:
        devF.append(rg.MeshFace(0,1,2))
    elif flen == 4:
        devF.append(rg.MeshFace(0,1,2,3))
    return pts
        
def FaceDev_(mesh, f1, f2, devV, devF, refV, refF):
    try:
        """"
        f1をもとにf2をxy平面に展開する
        前提として，f1はすでにxy平面に展開されており，もとのメッシュのfaceの接続グラフから，
        共通の頂点２つを導き，この頂点と辺をもとに展開する．
        """
        V = mesh.Vertices
        F = mesh.Faces
        flen = 3 if F[f2].IsTriangle else 4
        fpts2 = []
        for i in range(flen):
            fpts2.append(V[F[f2][i]])
        e = GetVertexPairTwoConnectedFaces(mesh, f1, f2)
        
        xaxis2 = rg.Vector3d.Subtract(rs.coerce3dvector(V[e.I]),rs.coerce3dvector(V[e.J]))
        zaxis2 = gc.FaceNormals(mesh)[1][f2]
        yaxis2 = rs.VectorCrossProduct(zaxis2,xaxis2)
        plan2 = rs.PlaneFromFrame(V[e.J],xaxis2, yaxis2)

        f_plane = devF[refF.index(f1)]
        for i in range(flen):
            if refV[f_plane[i]] == e.I:
                eI = f_plane[i]
            elif refV[f_plane[i]] == e.J:
                eJ = f_plane[i]
                
        #print(rg.Point3d(round(devV[eI][0], round_num),round(devV[eI][1], round_num),round(devV[eI][2], round_num)))
        
        xaxis1 = rg.Vector3d.Subtract(rs.coerce3dvector(devV[eI]),rs.coerce3dvector(devV[eJ]))
        zaxis1 = rg.Vector3d.ZAxis
        yaxis1 = rs.VectorCrossProduct(zaxis1,xaxis1)
        plan1 = rs.PlaneFromFrame(devV[eJ],xaxis1, yaxis1)
        
        pts = []
        pts_id = []
        ref_pt = []
        j = 0
        for i in range(flen):
            pt = gc.Orient(fpts2[i],plan2,plan1)[0]
            pt = rg.Point3d(round(pt[0], round_num),round(pt[1], round_num),round(pt[2], round_num))
            #print(pt)
            if pt in devV:
                pts_id.append(devV.index(pt))
            else:
                pts.append(pt)
                pts_id.append(len(devV) + j)
                ref_pt.append(F[f2][i])
                j += 1
        #print(pts_id)
        if flen == 3:
            face = rg.MeshFace(pts_id[0],pts_id[1],pts_id[2])
        elif flen == 4:
            face = rg.MeshFace(pts_id[0],pts_id[1],pts_id[2],pts_id[3])
        #face = rg.MeshFace(pts_id[0],pts_id[1],pts_id[2])
        
        
        devF.append(face)
        refF.append(f2)
        devV = devV + pts
        for i in range(len(ref_pt)):
            refV.append(ref_pt[i])
        #print(face)
        return devV
    except:
        pass
    
def GraphFaceDevelop(mesh,graph,sigma):
    devmeshes = []
    
    for tree in graph:
        devV = []
        devF = []
        
        sptree_sigma = tree
        
        sptree = []
        for e in sptree_sigma.edges:
            sptree.append([sigma.index(e[0]), sigma.index(e[1])])
        #print(sptree)
        root = sptree[0][0]
        
        refV = []   #新しく追加された点がoriginal meshのどの頂点だったか
        refF = []
        
        sortTree = TreeSort(sptree, root, mesh.Vertices.Count)
            
        devV = devV + FaceDev0(mesh, root, refV, devF)
        refF.append(root)
        
        #print(refV,refF)
        
        for e in sortTree:
            devV = FaceDev_(mesh, e[0], e[1], devV, devF, refV, refF)
            if devV == False:
                break
        net = gc.ConstructMesh(devV, devF)
        devmeshes.append(net)
    return devmeshes


def offset_toward_inside(curve, distance, center):
    vec = rg.Vector3d.Subtract(rs.coerce3dvector(curve.To),rs.coerce3dvector(curve.From))
    vc = rg.Vector3d.Subtract(rs.coerce3dvector(center),rs.coerce3dvector(gc.CurveMiddle(curve)))
    theta = get_angle_atan2(vc, vec)
    if theta >= 0:
        ln0 = gc.OffsetCurve(curve, distance, rg.Plane.WorldXY, 0)
    else:
        ln0 = gc.OffsetCurve(curve, -distance, rg.Plane.WorldXY, 0)
        
    return ln0
def extrude_toward_inside(curve, distance, center):
    vec = rg.Vector3d.Subtract(rs.coerce3dvector(curve.To),rs.coerce3dvector(curve.From))
    vc = rg.Vector3d.Subtract(rs.coerce3dvector(center),rs.coerce3dvector(gc.CurveMiddle(curve)))
    theta = get_angle_atan2(vc, vec)
    unit = rs.coerce3dvector(gc.Rotate(vec, math.pi/2, rg.Plane.WorldXY)[0])
    unit.Unitize()
    if theta >= 0:
        ln0 = gc.Extrude(curve, -distance*unit)
    else:
        ln0 = gc.Extrude(curve, distance*unit)
    return ln0
    
    
def add_protrudes(curve, baseline, length, ratio, w_airpath, fa_degree, face_center):
    try:
        protrude = []
        base_pts = gc.DivideCurve(baseline, div_num, False)[0]
        if base_pts[0] is not None and base_pts[1] is not None:
            seg_length = gc.Distance(base_pts[0],base_pts[1])
        
        c_middle = gc.CurveMiddle(curve)
        vec = rg.Vector3d.Subtract(rs.coerce3dvector(curve.To),rs.coerce3dvector(curve.From))
        vc = rg.Vector3d.Subtract(rs.coerce3dvector(face_center),rs.coerce3dvector(c_middle))
        vec.Unitize()
        unit = rs.coerce3dvector(gc.Rotate(vec, math.pi/2, rg.Plane.WorldXY)[0])
        unit.Unitize()
        theta = get_angle_atan2(vc, vec)
        if theta > 0:
            unit = -unit
            base_pts = gc.Move(base_pts, vec*seg_length/2)[0]
        else:
            unit = unit
        pts = gc.Move(base_pts, unit*length/ratio/2)[0]
        #pts = gc.DivideCurve(curve, div_num, False)[0]
        #for pt in pts[1:-1]:
        for pt in pts:
            if gc.Distance(pt, c_middle) >= w_airpath/2:
                if gc.Distance(gc.CurveClosestPoint(pt, curve)[0], curve.From) < 0.1 or gc.Distance(gc.CurveClosestPoint(pt, curve)[0], curve.To) < 0.1:
                    pass
                else:
                    pro = gc.LineSDL(pt, -unit, length/ratio * ((fa_degree)-93)/(-239))
                    protrude.append(pro)
        return protrude
    except:
        pass
    
    
def const_airpath(curve, w_airpath, face_center):
    c_middle = gc.CurveMiddle(curve)
    vec = rg.Vector3d.Subtract(rs.coerce3dvector(face_center),rs.coerce3dvector(c_middle))
    
    c_vec = rg.Vector3d.Subtract(rs.coerce3dvector(curve.To),rs.coerce3dvector(curve.From))
    c_vec.Unitize()
    pt0 = gc.Move(c_middle, -1*c_vec*w_airpath/2)[0]
    pt1 = gc.Move(c_middle, c_vec*w_airpath/2)[0]
    
    Vs = [pt0, pt1, gc.Move(pt1, vec)[0], gc.Move(pt0, vec)[0]]
    poly = gc.PolyLine(Vs, True)
    return poly
def const_double_bridge(baseline, ln_out, offset,  w_airpath):
    if offset != 0:
        base_middle = gc.CurveMiddle(baseline)
        base_vec = rg.Vector3d.Subtract(rs.coerce3dvector(baseline.To),rs.coerce3dvector(baseline.From))
        base_vec.Unitize()
        pt0 = gc.Move(base_middle, -1*base_vec*w_airpath/2)[0]
        pt1 = gc.Move(base_middle, base_vec*w_airpath/2)[0]
        
        ln_middle = gc.CurveMiddle(ln_out)
        ln_vec = rg.Vector3d.Subtract(rs.coerce3dvector(ln_out.To),rs.coerce3dvector(ln_out.From))
        ln_vec.Unitize()
        pt2 = gc.Move(ln_middle, -1*ln_vec*w_airpath/2)[0]
        pt3 = gc.Move(ln_middle, ln_vec*w_airpath/2)[0]
        
        if gc.Distance(pt0, pt2) > gc.Distance(pt0, pt3):
            return [gc.Line(pt0, pt3), gc.Line(pt1, pt2)]
        else:
            return [gc.Line(pt0, pt2), gc.Line(pt1, pt3)]
    else:
        pass
    
def make_airpath_on_singlepouch(pouch, baseline, ratio, w_airpath):
    ln_base_inside = offset_toward_inside(baseline, baseline.Length/ratio/2, rg.Point3d(0,0,0))
    pts_inside = gc.CurveXCurve(ln_base_inside, pouch)[0]
    ln_inside = gc.Line(pts_inside[0], pts_inside[1])
    ln_base_outside = offset_toward_inside(baseline, -(baseline.Length/ratio/2), rg.Point3d(0,0,0))
    pts_outside = gc.CurveXCurve(ln_base_outside, pouch)[0]
    ln_outside = gc.Line(pts_outside[0], pts_outside[1])
    
    mid_inside = gc.CurveMiddle(ln_inside)
    c_vec = rg.Vector3d.Subtract(rs.coerce3dvector(ln_inside.To),rs.coerce3dvector(ln_inside.From))
    c_vec.Unitize()
    pt0 = gc.Move(mid_inside, -1*c_vec*w_airpath/2)[0]
    pt1 = gc.Move(mid_inside, c_vec*w_airpath/2)[0]
    
    t_param0 = gc.CurveClosestPoint(pt0, pouch)[1]
    t_param1 = gc.CurveClosestPoint(pt1, pouch)[1]
    segs = gc.Shatter(pouch, [t_param0, t_param1])
    if gc.Length(segs[0]) > gc.Length(segs[1]):
        temp = segs[0]
    else:
        temp = segs[1]
    
    mid_outside = gc.CurveMiddle(ln_outside)
    c_vec = rg.Vector3d.Subtract(rs.coerce3dvector(ln_outside.To),rs.coerce3dvector(ln_outside.From))
    c_vec.Unitize()
    pt0 = gc.Move(mid_outside, -1*c_vec*w_airpath/2)[0]
    pt1 = gc.Move(mid_outside, c_vec*w_airpath/2)[0]
    
    t_param0 = gc.CurveClosestPoint(pt0, temp)[1]
    t_param1 = gc.CurveClosestPoint(pt1, temp)[1]
    segs = gc.Shatter(temp, [t_param0, t_param1])
    lengths = []
    for seg in segs:
        lengths.append(gc.Length(seg))
    id = lengths.index(min(lengths))
    del segs[id]
    return segs
    
def make_airpath_on_doublepouch(pouch, baseline, IE_length, ratio, w_airpath, center):
    ln_base_inside = offset_toward_inside(baseline, -(IE_length/ratio/2), center)
    pts_inside = gc.CurveXCurve(ln_base_inside, pouch)[0]
    ln_inside = gc.Line(pts_inside[0], pts_inside[1])
    ln_base_outside = offset_toward_inside(baseline, (IE_length/ratio/2), center)
    ln_base_outside = gc.Scale(ln_base_outside, gc.CurveMiddle(ln_base_outside), 2.0)
    pts_outside = gc.CurveXCurve(ln_base_outside, pouch)[0]
    ln_outside = gc.Line(pts_outside[0], pts_outside[1])
    mid_inside = gc.CurveMiddle(ln_inside)
    c_vec = rg.Vector3d.Subtract(rs.coerce3dvector(ln_inside.To),rs.coerce3dvector(ln_inside.From))
    c_vec.Unitize()
    pt0 = gc.Move(mid_inside, -1*c_vec*w_airpath/2)[0]
    pt1 = gc.Move(mid_inside, c_vec*w_airpath/2)[0]
    
    t_param0 = gc.CurveClosestPoint(pt0, pouch)[1]
    t_param1 = gc.CurveClosestPoint(pt1, pouch)[1]
    segs = gc.Shatter(pouch, [t_param0, t_param1])
    if gc.Length(segs[0]) > gc.Length(segs[1]):
        temp = segs[0]
    else:
        temp = segs[1]
    
    mid_outside = gc.CurveMiddle(ln_outside)
    c_vec = rg.Vector3d.Subtract(rs.coerce3dvector(ln_outside.To),rs.coerce3dvector(ln_outside.From))
    c_vec.Unitize()
    pt0 = gc.Move(mid_outside, -1*c_vec*w_airpath/2)[0]
    pt1 = gc.Move(mid_outside, c_vec*w_airpath/2)[0]
    
    t_param0 = gc.CurveClosestPoint(pt0, temp)[1]
    t_param1 = gc.CurveClosestPoint(pt1, temp)[1]
    segs = gc.Shatter(temp, [t_param0, t_param1])
    lengths = []
    for seg in segs:
        lengths.append(gc.Length(seg))
    id = lengths.index(min(lengths))
    del segs[id]
    return segs
    
def make_airpath_on_path(airpath, pouch):
    pts = gc.CurveXCurve(airpath, pouch)[0]
    t_params = []
    for pt in pts:
        t_params.append(gc.CurveClosestPoint(pt, airpath)[1])
    segs = gc.Shatter(airpath, t_params)
    lengths = []
    for seg in segs:
        lengths.append(gc.Length(seg))
    id = lengths.index(min(lengths))
    del segs[id]
    if len(segs) == 1:
        return segs[0]
    else:
        return segs
    
    
def GetFA(mesh3d, mesh2d, refF):
    mesh2d.UnifyNormals()
    mesh3d.UnifyNormals()
    
    FAG = GetFAG(mesh2d)
    print(FAG.edges)
    sigma = EnumSPTrees(FAG)
    
    #重心
    centers = gc.FaceNormals(mesh2d)[0]
    
    Es = []
    Ilines = []
    Elines = []
    folding_angle = []
    center_lines = []
    
    for i in range(mesh2d.TopologyEdges.Count):
        # ith topologyedgeに隣接しているfaceのidを取得
        cf = mesh2d.TopologyEdges.GetConnectedFaces(i)
        
        if len(cf) == 2:# inner edgeの場合
        
            # inner edgeをlineとして生成
            iline = mesh2d.TopologyEdges.EdgeLine(i)
            Ilines.append(iline)
            
            # folding angleを取得
            #fa = GetFoldingAngles(mesh3d, refF.index(cf[0]), refF.index(cf[1])) #radian
            #print(cf)
            fa = GetFoldingAngles(mesh3d, refF[cf[0]], refF[cf[1]]) #radian
            folding_angle.append(fa)
            
            center_lines.append(rg.Line(rg.Point3d(centers[cf[0]]), rg.Point3d(gc.CurveMiddle(iline))))
            center_lines.append(rg.Line(rg.Point3d(centers[cf[1]]), rg.Point3d(gc.CurveMiddle(iline))))
        else:
            
            # exterior edgeをlineとして生成
            eline = mesh2d.TopologyEdges.EdgeLine(i)
            Elines.append(eline)
            
    return Ilines, Elines, folding_angle ,center_lines  
    
def main(mesh3d, mesh2d, ratio, offset, w_air, refF):
    faceboundary = gc.FaceBoundaries(mesh2d)
    fa = GetFA(mesh3d, mesh2d, refF)[2]
    Vs = mesh2d.Vertices
    #print(fa)
    
    
    E = mesh2d.TopologyEdges
    Es = []
    for e in range(E.Count):
        v = E.GetTopologyVertices(e)
        i = v.I
        j = v.J
        Es.append([i,j])                #Esはエッジを構成する頂点のペアの集合
    NE = GetTopologyNakedEdgesList(mesh2d)
    print('NE={}'.format(NE))
    IE = GetTopologyInnerEdgesList(mesh2d)[0]#IEはinner edge
    print('IE={}'.format(IE))
    
    Lines = []
    pts0 = []
    tmp = []
    pouches_dict = defaultdict(list)
    pouches = []
    edge_baseline_dict = defaultdict(list)
    edge_singleordouble_dict = {}
    front_panel = []
    rect_front = []
    back_panel = []
    rect_back = []
    protrudes = []
    airpaths = []
    airpaths_double = []
    reconstructed_pouch = []
    centers = gc.FaceNormals(mesh2d)[0]
    dict_pouch_from_airpathid = []
    dict_pouch_from_airpathid_double = []
    
    airpaths_front = []
    airpaths_back = []
    
    for id in range(mesh2d.Faces.Count):
        print(id)
        fEid = mesh2d.TopologyEdges.GetEdgesForFace(id)      #インデックスがidであるfaceを取り囲む(=faceを形成する)頂点の集合。三角faceなら要素数は3
        fE = []
        
        if mesh2d.Faces.Item[id].IsQuad:
            num = 4
            for i in range(num):
                fEi = E.GetTopologyVertices(fEid[i])
                fEi = [fEi.I, fEi.J]
                fE.append(fEi)
        else:
            num = 3
            for i in range(num):
                fEi = E.GetTopologyVertices(fEid[i])
                fEi = [fEi.I, fEi.J]
                fE.append(fEi)
        print('fE = {}'.format(fE))
        
        pouch = []
        if True:
            Vint = []
            fEord = []
            for i in range(num):
                if i != num-1:
                    e = [mesh2d.Faces.Item[id][i], mesh2d.Faces.Item[id][i+1]]
                else:
                    e = [mesh2d.Faces.Item[id][num-1], mesh2d.Faces.Item[id][0]]
                fEord.append(e) #fEordはM.Faces.Item[id]の要素のペア
                
            
            lns_inside = []
            lns_outside = []
            for e in fE:
                ln = E.EdgeLine(Es.index(e))
                length = ln.Length
                ln = gc.Scale(ln, gc.CurveMiddle(ln),2.0)[0]
                if e in NE:
                    lns_inside.append(ln)
                    lns_outside.append(ln)
                if e in IE:
                    if math.fabs(fa[IE.index(e)]) > math.pi/2:
                        offset_e = offset/2 + length/ratio/2
                        edge_singleordouble_dict[str(e)] = 'double'
                        baseline = offset_toward_inside(ln, offset_e, centers[id])
                        
                        ln_inside = offset_toward_inside(baseline.Line, length/ratio/2, centers[id])
                        pts = gc.CurveXCurve(ln_inside, faceboundary[id])[0]
                        pts0.append(pts[0])
                        ln_inside = gc.Line(pts[0], pts[1])
                        
                        
                        ln_outside = offset_toward_inside(baseline.Line, -length/ratio/2, centers[id])
                        pts = gc.CurveXCurve(ln_outside, faceboundary[id])[0] 
                        pts0.append(pts[0])
                        ln_outside = gc.Line(pts[0], pts[1])
                        
                        lns_inside.append(ln_inside)
                        lns_outside.append(ln_outside)
                        
                    else:
                        baseline = ln
                        edge_singleordouble_dict[str(e)] = 'single'
                        lns_outside.append(ln)
                        ln = offset_toward_inside(ln, length/ratio/2, centers[id])
                        pts = gc.CurveXCurve(ln, faceboundary[id])[0]
                        pts0.append(pts[0])
                        ln = gc.Line(pts[0], pts[1])
                        lns_inside.append(ln)
                        
            polys_large = []
            polys = []
            for i in range(num):
                Vint = []
                Vint_large = []
                if i == 0:
                    iplus = i + 1; iminus =  num - 1
                elif i == num - 1:
                    iplus = 0; iminus =  i - 1
                else:
                    iplus = i + 1; iminus = i - 1
                Vint.append(rs.coerce3dpoint(LinesIntersect2D(lns_inside[i], lns_inside[iplus])))
                v0 = rs.coerce3dpoint(LinesIntersect2D(lns_outside[i], lns_outside[iplus]))
                Vint.append(rs.coerce3dpoint(LinesIntersect2D(lns_outside[i], lns_outside[iplus])))
                Vint.append(rs.coerce3dpoint(LinesIntersect2D(lns_outside[i], lns_outside[iminus])))
                Vint.append(rs.coerce3dpoint(LinesIntersect2D(lns_inside[i], lns_inside[iminus])))
                v1 = rs.coerce3dpoint(LinesIntersect2D(lns_outside[i], lns_outside[iminus]))
                if gc.Distance(v0, Vs[fE[i][0]]) <= gc.Distance(v1, Vs[fE[i][0]]):
                    Vint_large = [v0,Vs[fE[i][0]],Vs[fE[i][1]],v1]
                else:
                    Vint_large = [v0,Vs[fE[i][1]],Vs[fE[i][0]],v1]
                if not (gc.Distance(Vint[0], Vint[1]) < 0.01 or gc.Distance(Vint[2], Vint[3]) < 0.01):
                    poly = gc.PolyLine(Vint, True)
                    polys.append(poly)
                    
                    if not (gc.Distance(Vint_large[0], Vint_large[1]) < 0.01 or gc.Distance(Vint_large[2], Vint_large[3]) < 0.01):
                        poly_large = gc.PolyLine(Vint_large, True)
                        polylines = [poly, poly_large]
                        poly_large = gc.RegionUnion(polylines)
                        polys_large.append(poly_large)
                else:
                    polys.append(None)
                    polys_large.append(None)
                
            
            M = []
            V = []
            airpath = []
            airpath_double = []
            airpath_dict = []
            airpath_dict_double = []
            airpath_front = []
            airpath_back = []
            
            area = faceboundary[id]
            #return area, Vint , polys,polys_large,polys,polys
            area0 = area
            for p in polys_large:
                if gc.Area(p)[0] is not None:
                    area = gc.RegionDifference(area, p)
                else:
                    pass
            for p in polys:
                if gc.Area(p)[0] is not None:
                    area = gc.RegionDifference(area, p)
                else:
                    pass
            print(gc.Area(area)[0])
            #return area, polys_large, polys, polys_large, area0, Vint, polys_large, area0, Vint
            if gc.Area(area)[0] is not None:
                M.append(area)
                V.append(area)
            for i in range(num):
                e = fE[i]
                if i == 0:
                    iplus = i + 1; iminus =  num - 1
                elif i == num - 1:
                    iplus = 0; iminus =  i - 1
                else:
                    iplus = i + 1; iminus = i - 1
                #print(fE[i])
                if fE[i] in IE:
                    #print('single or double = '+ edge_singleordouble_dict[str(fE[i])])
                    
                    if edge_singleordouble_dict[str(fE[i])] == 'single':
                        pou = polys[i]
                        pouches_dict[str(e)].append(polys[i])
                        
                        ln = E.EdgeLine(Es.index(e))
                        length = ln.Length
                        ln = gc.Scale(ln, gc.CurveMiddle(ln),2.0)[0]
                        
                        ln = offset_toward_inside(ln, length/ratio/2, centers[id])
                        pts = gc.CurveXCurve(ln, polys[i])[0]
                        line = gc.Line(pts[0], pts[1])
                        protrudes.append(add_protrudes(line, E.EdgeLine(Es.index(e)), length, ratio, w_air, math.fabs(fa[IE.index(e)])*180/math.pi, gc.FaceNormals(mesh2d)[0][id]))

                        #const_airpath(curve, w_airpath, face_center)
                        path = const_airpath(line, w_air, centers[id])
                        airpath.append(path)
                        airpath_dict.append(IE.index(fE[i]))
                        
                        if fa[IE.index(e)] < 0:
                            airpath_front.append(path)
                        else:
                            airpath_back.append(path)
                            
                        
                        
                        
                    elif edge_singleordouble_dict[str(fE[i])] == 'double':
                        #print('double')
                        ln = E.EdgeLine(Es.index(e))
                        length = E.EdgeLine(Es.index(e)).Length
                        ln = gc.Scale(ln, gc.CurveMiddle(ln),2.0)[0]
                        
                        offset_e = offset/2 + length/ratio/2
                        baseline = offset_toward_inside(ln, offset_e, centers[id])
                        
                        pts = gc.CurveXCurve(baseline, polys[i])[0]
                        line = gc.Line(pts[0], pts[1])
                        
                        edge_baseline_dict[str(e)].append(line)
                        pouches_dict[str(e)].append(polys[i])
                        
                        v0 = rs.coerce3dpoint(LinesIntersect2D(lns_inside[i], lns_inside[iplus]))
                        v1 = rs.coerce3dpoint(LinesIntersect2D(lns_inside[i], lns_inside[iminus]))
                        if gc.Distance(v0, pts[0]) <= gc.Distance(v1, pts[0]):
                            Vs_halfpouch = [v0,pts[0],pts[1],v1]
                        else:
                            Vs_halfpouch = [v0,pts[1],pts[0],v1]
                        pou = gc.PolyLine(Vs_halfpouch, True)
                        #pouch.append(pou)
                        #tmp.append(gc.PolyLine(Vs, True))
                        
                        connected_faces = E.GetConnectedFaces(Es.index(e))
                        #print(connected_faces)
                        ln_base_inside = offset_toward_inside(E.EdgeLine(Es.index(fE[i])), offset/2 + length/ratio, centers[id])
                        pts_inside = gc.CurveXCurve(ln_base_inside, polys[i])[0]
                        ln_inside = gc.Line(pts_inside[0], pts_inside[1])
                        ln_base_outside = offset_toward_inside(E.EdgeLine(Es.index(fE[i])), offset/2 , centers[id])
                        pts_outside = gc.CurveXCurve(ln_base_outside, polys[i])[0]
                        ln_outside = gc.Line(pts_outside[0], pts_outside[1])
                        
                        baseline = offset_toward_inside(E.EdgeLine(Es.index(fE[i])), offset/2 + length/ratio/2, centers[id])
                        pts_base = gc.CurveXCurve(baseline, polys[i])[0]
                        baseline = gc.Line(pts_base[0], pts_base[1])
                        if id == connected_faces[0]:#90degree
                            protrudes.append(add_protrudes(ln_inside, baseline, length, ratio, w_air, 90, centers[id]))
                            protrudes.append(add_protrudes(ln_outside, baseline, length, ratio, w_air, 90, centers[id]))
                        elif id == connected_faces[1]:#angle-90degree
                            #protrudes.append(add_protrudes(ln_inside, baseline, length, ratio, w_air, math.fabs(fa[IE.index(e)])*180/math.pi - 90, centers[id]))
                            #protrudes.append(add_protrudes(ln_outside, baseline,  -length, ratio, w_air, math.fabs(fa[IE.index(e)])*180/math.pi - 90, centers[id]))
                            protrudes.append(add_protrudes(ln_inside, baseline, -length, ratio, w_air, math.fabs(fa[IE.index(e)])*180/math.pi - 90, gc.CurveMiddle(ln_outside)))
                            protrudes.append(add_protrudes(ln_outside, baseline,  -length, ratio, w_air, math.fabs(fa[IE.index(e)])*180/math.pi - 90, gc.CurveMiddle(ln_inside)))
                        
                        path = const_airpath(ln_inside, w_air, centers[id])
                        airpath.append(path)
                        airpath_dict.append(IE.index(fE[i]))
                                                
                        
                        airpath_double.append(const_double_bridge(E.EdgeLine(Es.index(e)), ln_outside, offset,  w_air))
                        #airpath_double.append(const_airpath(E.EdgeLine(Es.index(e)), w_air, offset, gc.CurveMiddle(ln_outside)))
                        airpath_dict_double.append(IE.index(fE[i]))
                        
                        if fa[IE.index(e)] < 0:
                            airpath_front.append(path)
                        else:
                            airpath_back.append(path)
                            
                    else:
                        pass
                        #print(edge_singleordouble_dict[str(fE[i])])
                        
                    if fa[IE.index(e)] >= 0:
                        M.append(pou)
                    else:
                        V.append(pou)
            
            M = gc.RegionUnion(M)
            V = gc.RegionUnion(V)
            Lines.append(polys)
            Lines.append(polys_large)
            airpath.append(gc.Circle(gc.FaceNormals(mesh2d)[0][id], w_air/2))
            airpath = gc.RegionUnion(airpath)
            
            #airpath_double = gc.RegionUnion(airpath_double)
            
            dict_pouch_from_airpathid.append(airpath_dict)
            dict_pouch_from_airpathid_double.append(airpath_dict_double)
            
            if len(airpath_front) >= 1:
                airpath_front.append(gc.Circle(centers[id], w_air/2))
                airpath_front = gc.RegionUnion(airpath_front)
            if len(airpath_back) >= 1:
                airpath_back.append(gc.Circle(centers[id], w_air/2))
                airpath_back = gc.RegionUnion(airpath_back)
            
            
        front_panel.append(M)
        back_panel.append(V)
        pouches.append(pouch)
        airpaths.append(airpath)
        airpaths_double.append(airpath_double)
        if airpath_front != []:
            airpaths_front.append(airpath_front)
        if airpath_back != []:
            airpaths_back.append(airpath_back)
    tmp = airpaths_double
        
    for i in range(len(IE)): #rect panelと分かれているpouchのunion
        if edge_singleordouble_dict[str(IE[i])] == 'double':
            length = E.EdgeLine(Es.index(IE[i])).Length
            offset_e = offset/2 + length/ratio/2
            #print(offset_e)
            ln0 = edge_baseline_dict[str(IE[i])][0]
            v0 = rg.Vector3d.Subtract(rs.coerce3dvector(ln0.To),rs.coerce3dvector(ln0.From))
            ln1 = edge_baseline_dict[str(IE[i])][1]
            v1 = rg.Vector3d.Subtract(rs.coerce3dvector(ln1.To),rs.coerce3dvector(ln1.From))
            v_middle = rg.Vector3d.Subtract(rs.coerce3dvector(gc.CurveMiddle(ln1)),rs.coerce3dvector(gc.CurveMiddle(ln0)))
                        
            if v0 * v1 >= 0:
                v_from_0 = ln0.From; v_from_1 = ln1.From; v_to_0 = ln0.To; v_to_1 = ln1.To
            else:
                v_from_0 = ln0.From; v_from_1 = ln1.To; v_to_0 = ln0.To; v_to_1 = ln1.From
            
            vec_offset = rs.coerce3dvector(gc.Rotate(v0, math.pi/2, rg.Plane.WorldXY)[0])
            if v_middle * vec_offset >= 0:
                vec_offset = -1 * vec_offset
            else:
                pass
            vec_offset.Unitize()
            v_from_1_moved = gc.Move(v_from_1, vec_offset*offset_e*2)[0]
            if gc.Distance(v_to_0, v_from_1_moved) >= gc.Distance(v_to_0, v_from_0):
                pt_from = v_from_0
            else:
                pt_from = v_from_1_moved
            
            v_to_1_moved = gc.Move(v_to_1, vec_offset*offset_e*2)[0]
            if gc.Distance(v_from_0, v_to_1_moved) >= gc.Distance(v_from_0, v_to_0):
                pt_to = v_to_0
            else:
                pt_to = v_to_1_moved
            
            ln = gc.Line(pt_to, pt_from)
            rect = extrude_toward_inside(ln, offset_e*2, gc.CurveMiddle(gc.Line(Vs[IE[i][0]],Vs[IE[i][1]])))
            
            if fa[i] >= 0:
                rect = gc.BrepEdges(rect)[0]
                rect = gc.JoinCurves(rect)
                rect_front.append(rect)
            else:
                rect = gc.BrepEdges(rect)[0]
                rect = gc.JoinCurves(rect)
                rect_back.append(rect)
            
            center = gc.CurveMiddle( E.EdgeLine(Es.index(IE[i])))

            pouches.append(make_airpath_on_doublepouch(pouches_dict[str(IE[i])][0], edge_baseline_dict[str(IE[i])][0], E.EdgeLine(Es.index(IE[i])).Length ,ratio, w_air, center))
            pouches.append(make_airpath_on_doublepouch(pouches_dict[str(IE[i])][1], edge_baseline_dict[str(IE[i])][1], E.EdgeLine(Es.index(IE[i])).Length ,ratio, w_air, center))
            #pouches.append(make_airpath_on_doublepouch(pouches_dict[str(IE[i])][0], E.EdgeLine(Es.index(IE[i])), ratio, offset, w_air))
            
            
        elif edge_singleordouble_dict[str(IE[i])] == 'single':
            pouch = gc.RegionUnion([pouches_dict[str(IE[i])][0],pouches_dict[str(IE[i])][1]])
            #pouches.append(pouch)
            pouches.append(make_airpath_on_singlepouch(pouch, E.EdgeLine(Es.index(IE[i])), ratio, w_air))
    
    
    #tmp = pouches_dict[str(IE[dict_pouch_from_airpathid[0][0]])][1]
    reconst_airpath =[]
    for i in range(len(airpaths)):
        path = airpaths[i]
        for j in range(len(dict_pouch_from_airpathid[i])):
            cutten_path = []
            pouch_list = pouches_dict[str(IE[dict_pouch_from_airpathid[i][j]])]#2つのはず
            p0 = pouch_list[0]
            p1 = pouch_list[1]
            if not isinstance(path, list):  #pathが長さ1
                if gc.CurveXCurve(path, p0)[0] is not None:
                    path = make_airpath_on_path(path, p0)
                elif gc.CurveXCurve(path, p1)[0] is not None:
                    path = make_airpath_on_path(path, p1)
            else:
                for k in range(len(path)):
                    pa = path[k]
                    if gc.CurveXCurve(pa, p0)[0] is not None:
                        for l in range(len(path)):
                            if l != k:
                                cutten_path.append(path[l])
                        path = make_airpath_on_path(pa, p0)
                        path.extend(cutten_path)
                        break
                    elif gc.CurveXCurve(pa, p1)[0] is not None:
                        for l in range(len(path)):
                            if l != k:
                                cutten_path.append(path[l])
                        path = make_airpath_on_path(pa, p1)
                        path.extend(cutten_path)
                        break
        reconst_airpath.append(path)
    
    
    #front_panel = gt.list_to_tree(front_panel)
    #back_panel = gt.list_to_tree(back_panel)
    Lines = gt.list_to_tree(Lines)
    pouches = gt.list_to_tree(pouches)
    
    front_panels = gc.RegionDifference(front_panel, airpaths_front)
    if len(rect_front) >= 1:
        front_panels.extend(rect_front)
    back_panels = gc.RegionDifference(back_panel, airpaths_back)
    if len(rect_back) >= 1:
        back_panels.extend(rect_back)
    
    return front_panels, back_panels, pouches, airpaths_front, airpaths_back, protrudes, reconst_airpath, airpaths_double,tmp
    
if __name__ == "__main__":
    print(refF)
    #import warnings
    #warnings.filterwarnings("ignore")
    #warnings.simplefilter('ignore')
    res = main(mesh3D, mesh2D, as_ratio, offset_doublehinge, airpath_width, refF)
    frontpanel = res[0]
    frontpanel = gt.list_to_tree(frontpanel)
    backpanel = res[1]
    pouch = res[2]
    front_visualization = res[3]
    front_visualization = gt.list_to_tree(front_visualization)
    back_visualization = res[4]
    back_visualization = gt.list_to_tree(back_visualization)
    protrudes = res[5]
    protrudes = gt.list_to_tree(protrudes)
    airpath = res[6]
    airpath = gt.list_to_tree(airpath)
    airpath_double = res[7]
    airpath_double = gt.list_to_tree(airpath_double)
    #reconstructed_pouch = res[8]
    #reconstructed_pouch = gt.list_to_tree(reconstructed_pouch)
    tmp = res[-1]
    tmp = gt.list_to_tree(tmp)
    
    """
    refFは、もとのidがどのidかをしめす
    ref[1] = 4は、もとのメッシュのf4が今のf1になっていることを示す
    """
# ---------- end pouchandpanel ----------
panel_4 = Panel(pouchandpanel.out)
preview_2 = CustomPreview(Geometry=pouchandpanel.front_visualization, Material=ColourSwatch(SwatchColor=RGB(255, 0, 0)))
preview_3 = CustomPreview(Geometry=pouchandpanel.back_visualization, Material=ColourSwatch(SwatchColor=RGB(0, 68, 255)))
merge = Merge(
    Data1=pouchandpanel.pouch,
    Data2=pouchandpanel.protrudes,
    Data3=pouchandpanel.airpath,
    Data4=pouchandpanel.airpath_double)
preview_4 = CustomPreview(Geometry=pouchandpanel.pouch, Material=ColourSwatch(SwatchColor=RGBA(0, 0, 0, 66)))

# ----
# output 2D data
# panel data (front)
# panel data (back)
# pouch data
swatch = ColourSwatch(SwatchColor=RGB(255, 0, 0))
preview_5 = CustomPreview(Geometry=pouchandpanel.backpanel, Material=ColourSwatch(SwatchColor=RGB(0, 68, 255)))
preview_6 = CustomPreview(Geometry=pouchandpanel.frontpanel, Material=swatch)
preview_7 = CustomPreview(Geometry=merge, Material=ColourSwatch(SwatchColor=RGBA(0, 0, 0, 66)))
